# Grasshopper definition 3b-3.gh (Grasshopper 1.0.7)
# plug-ins: Kangaroo Components, Human

# ----
# O( in  a surface frame at UV coordinates defines a local coordinate system (plane) on a NURBS surface at a specific U,V point. Z is the normal.
# K1 - is maximum principal curvature described at Z
# K2 - minimum pricinapl curvature at Z
panel = Panel("3bodyout")
concat = Concatenate(FragmentC="C:\Users\KarlRoesch\physVLA\3body", FragmentD="\", FragmentA=panel, FragmentB=".csv")
file = ReadFile(File=concat, PerLineParse=True)
dispatch = Dispatch(List=file, DispatchPattern=[True, False])  # -> ListA, flatten(ListB)
split = TextSplit(Text=dispatch.ListB, Separators=",")
sift = SiftPattern(List=split, SiftPattern=[0, 1, 2, 3, 4, 5, 6, 7, 8, 9])  # -> flatten(Output0), flatten(Output1), flatten(Output2), flatten(Output3), flatten(Output4), flatten(Output5), flatten(Output6), flatten(Output7), flatten(Output8)
clean = CleanTree(RemoveNulls=True, RemoveInvalid=True, RemoveEmpty=False, Tree=sift.Output7)
clean_2 = CleanTree(RemoveNulls=True, RemoveInvalid=True, RemoveEmpty=False, Tree=sift.Output8)
clean_3 = CleanTree(RemoveNulls=True, RemoveInvalid=True, RemoveEmpty=False, Tree=sift.Output1)
clean_4 = CleanTree(RemoveNulls=True, RemoveInvalid=True, RemoveEmpty=False, Tree=sift.Output2)
clean_5 = CleanTree(RemoveNulls=True, RemoveInvalid=True, RemoveEmpty=False, Tree=sift.Output6)
clean_6 = CleanTree(RemoveNulls=True, RemoveInvalid=True, RemoveEmpty=False, Tree=sift.Output0)
clean_7 = CleanTree(RemoveNulls=True, RemoveInvalid=True, RemoveEmpty=False, Tree=sift.Output4)
clean_8 = CleanTree(RemoveNulls=True, RemoveInvalid=True, RemoveEmpty=False, Tree=sift.Output5)
clean_9 = CleanTree(RemoveNulls=True, RemoveInvalid=True, RemoveEmpty=False, Tree=sift.Output3)
pt = ConstructPoint(XCoordinate=clean_5, YCoordinate=clean, ZCoordinate=clean_2)  # -> flatten(Point)
pt_2 = ConstructPoint(XCoordinate=clean_6, YCoordinate=clean_3, ZCoordinate=clean_4)  # -> flatten(Point)
pt_3 = ConstructPoint(XCoordinate=clean_9, YCoordinate=clean_7, ZCoordinate=clean_8)  # -> flatten(Point)
number_slider = Slider(700, range=0..1271)
split_2 = SplitList(List=pt_2, Index=number_slider)  # -> ListA, ListB
item = ListItem(List=pt_2, Index=number_slider, Wrap=True)
split_3 = SplitList(List=pt_3, Index=Slider(700, range=0..1271))  # -> ListA, ListB
split_4 = SplitList(List=pt, Index=Slider(700, range=0..1271))  # -> ListA, ListB
pline = PolyLine(Vertices=split_2.ListB, Closed=False)
pline_2 = PolyLine(Vertices=split_3.ListB, Closed=False)
pline_3 = PolyLine(Vertices=split_4.ListB, Closed=False)
edgesrf = EdgeSurface(CurveA=pline, CurveB=pline_2)
edgesrf_2 = EdgeSurface(CurveA=pline_2, CurveB=pline_3)
edgesrf_3 = EdgeSurface(CurveA=pline_3, CurveB=pline)
debrep = DeconstructBrep(Brep=edgesrf)  # -> reparameterize(Faces), Edges, Vertices
debrep_2 = DeconstructBrep(Brep=edgesrf_3)  # -> reparameterize(Faces), Edges, Vertices
debrep_3 = DeconstructBrep(Brep=edgesrf_2)  # -> reparameterize(Faces), Edges, Vertices
curvature = PrincipalCurvature(Surface=debrep_2.Faces, Point=debrep_2.Vertices)  # -> Frame, Maximum, Minimum, MaxDirection, MinDirection
curvature_2 = PrincipalCurvature(Surface=debrep.Faces, Point=debrep.Vertices)  # -> Frame, Maximum, Minimum, MaxDirection, MinDirection
curvature_3 = PrincipalCurvature(Surface=debrep_3.Faces, Point=debrep_3.Vertices)  # -> Frame, Maximum, Minimum, MaxDirection, MinDirection
clean_10 = CleanTree(RemoveNulls=True, RemoveInvalid=True, RemoveEmpty=False, Tree=curvature_2.Frame)  # -> flatten(Tree)
clean_11 = CleanTree(RemoveNulls=True, RemoveInvalid=True, RemoveEmpty=False, Tree=curvature_2.MinDirection)  # -> flatten(Tree)
clean_12 = CleanTree(RemoveNulls=True, RemoveInvalid=True, RemoveEmpty=False, Tree=curvature_2.MaxDirection)  # -> flatten(Tree)
clean_13 = CleanTree(RemoveNulls=True, RemoveInvalid=True, RemoveEmpty=False, Tree=curvature.Frame)  # -> flatten(Tree)
clean_14 = CleanTree(RemoveNulls=True, RemoveInvalid=True, RemoveEmpty=False, Tree=curvature.MinDirection)  # -> flatten(Tree)
clean_15 = CleanTree(RemoveNulls=True, RemoveInvalid=True, RemoveEmpty=False, Tree=curvature.MaxDirection)  # -> flatten(Tree)
clean_16 = CleanTree(RemoveNulls=True, RemoveInvalid=True, RemoveEmpty=False, Tree=curvature_3.Frame)  # -> flatten(Tree)
clean_17 = CleanTree(RemoveNulls=True, RemoveInvalid=True, RemoveEmpty=False, Tree=curvature_3.MinDirection)  # -> flatten(Tree)
clean_18 = CleanTree(RemoveNulls=True, RemoveInvalid=True, RemoveEmpty=False, Tree=curvature_3.MaxDirection)  # -> flatten(Tree)
panel_2 = Panel(clean_10)
panel_3 = Panel(clean_11)
panel_4 = Panel(clean_12)
panel_5 = Panel(clean_13)
panel_6 = Panel(clean_14)
panel_7 = Panel(clean_15)
panel_8 = Panel(clean_16)
panel_9 = Panel(clean_17)
panel_10 = Panel(clean_18)
concat_2 = Concatenate(FragmentA=panel_2, FragmentB=" K1", FragmentC=panel_4, FragmentD=" K2", FragmentE=panel_3)
concat_3 = Concatenate(FragmentA=panel_8, FragmentB=" K1", FragmentC=panel_10, FragmentD=" K2", FragmentE=panel_9)
concat_4 = Concatenate(FragmentA=panel_5, FragmentB=" K1", FragmentC=panel_7, FragmentD=" K2", FragmentE=panel_6)
merge = Merge(Data1=concat_2, Data2=concat_3, Data3=concat_4)
concat_5 = Concatenate(FragmentC="C:\Users\KarlRoesch\physVLA\3body", FragmentD="\", FragmentA="3bodyoutcombined", FragmentB=".csv")
text_data = Text(flatten(merge))
path = FilePath(concat_5)
txtwriter = VBScript(filePath=path, data=text_data, append=Toggle(True), activate=Toggle(False), clearFile=Toggle(False))  # -> out, A; inputs data: list
# ---------- txtwriter: VB usings ----------
Imports System.IO
Imports System.Linq
Imports System.Data
Imports System.Drawing
Imports System.Reflection
Imports System.Windows.Forms
Imports System.Xml
Imports System.Xml.Linq
Imports Microsoft.VisualBasic
Imports System.Runtime.InteropServices

Imports Rhino.DocObjects
Imports Rhino.Collections
Imports GH_IO
Imports GH_IO.Serialization
# ---------- txtwriter: VB ----------
    If activate Then

      Dim i As Integer
      Dim aryText(4) As String

      aryText(0) = "True"
      aryText(1) = "Had"
      aryText(2) = "Another"
      aryText(3) = "Little"
      aryText(4) = "One"

      ' the data is appended to the file. If file doesnt exist, a new file is created
      Dim objWriter As New System.IO.StreamWriter(filePath, append)

      For i = 0 To data.Count - 1
        objWriter.WriteLine(data(i))
      Next

      objWriter.Close()
      
      A = aryText(0)

    End If

    If clearFile Then
      Dim objWriter As New System.IO.StreamWriter(filePath, False)
      objWriter.Close()
    End If
# ---------- end txtwriter ----------

pt_4 = Point(Point(2.479143998, -12.52596202, 0))
pt_5 = Point(Point(25.43049257, -2.98939059, 0))
pt_6 = Point(Point(3.750686855, 12.01481513, 0))
Z = UnitZ(Factor=Slider(3, range=0..10))
Z_2 = UnitZ(Factor=Slider(4, range=0..10))
Z_3 = UnitZ(Factor=Slider(3, range=0..10))
Z_4 = UnitZ(Factor=Slider(3, range=0..10))
pt_7 = Point(Point(-0.3182502881, 23.64943227, 0))
pt_8 = Point(Point(40.94331543, -7.630522019, 0))
Z_5 = UnitZ(Factor=Slider(4, range=0..10))
Z_6 = UnitZ(Factor=Slider(3, range=0..10))
pt_9 = Point(Point(-6.421656003, -22.82545916, 0))
move = Move(Geometry=pt_6, Motion=Z)  # -> Geometry, Transform
move_2 = Move(Geometry=pt_5, Motion=Z_2)  # -> Geometry, Transform
move_3 = Move(Geometry=pt_4, Motion=Z_3)  # -> Geometry, Transform
move_4 = Move(Geometry=pt_7, Motion=Z_4)  # -> Geometry, Transform
move_5 = Move(Geometry=pt_8, Motion=Z_5)  # -> Geometry, Transform
move_6 = Move(Geometry=pt_9, Motion=Z_6)  # -> Geometry, Transform
trigger = Trigger(Interval=200, TimerInterval=200, Target=python)  # disabled
button = Button()
vec2pt = Vector2Pt(PointA=pt_6, PointB=move_4.Geometry, Unitize=False)  # -> Vector, Length
vec2pt_2 = Vector2Pt(PointA=pt_4, PointB=move_6.Geometry, Unitize=False)  # -> Vector, Length
vec2pt_3 = Vector2Pt(PointA=pt_5, PointB=move_5.Geometry, Unitize=False)  # -> Vector, Length
ln = Line(StartPoint=move_2.Geometry, EndPoint=move_3.Geometry)
ln_2 = Line(StartPoint=move_3.Geometry, EndPoint=move.Geometry)
ln_3 = Line(StartPoint=move.Geometry, EndPoint=move_2.Geometry)
python = GhPythonScript()  # -> a
# ---------- python: Python ----------
from ghpythonlib.componentbase import executingcomponent as component
import Grasshopper, GhPython
import System
import Rhino
import rhinoscriptsyntax as rs

T = 0

class MyComponent(component):
    
    def RunScript(self, ):
        global T
                
        T += 200
        
        return T
# ---------- end python ----------
timestep = TimeStep(python)
kangaroo_settings = KangarooSettings(
    Tolerance=0.001,
    TimeStep=timestep,
    SubIterations=40,
    Floor=False,
    Drag=0,
    Restitution=0.7,
    StaticFriction=10,
    KineticFriction=10,
    Settle=2,
    Tumble=1,
    Sound=False,
    Solver=0)
plaw = PowerLaw(Connection=ln, Exponents=-1, Strength=Slider(-5000, range=-10000..1000), Cutoff=0)
plaw_2 = PowerLaw(Connection=ln_3, Exponents=-1, Strength=Slider(-5000, range=-10000..1000), Cutoff=0)
plaw_3 = PowerLaw(Connection=ln_2, Exponents=-1, Strength=Slider(-5000, range=-10000..1000), Cutoff=0)
particle = Particle(Point=move_3.Geometry, Mass=Slider(100, range=0..100), Velocity=vec2pt_2.Vector)
particle_2 = Particle(Point=move_2.Geometry, Mass=Slider(100, range=0..100), Velocity=vec2pt_3.Vector)
particle_3 = Particle(Point=move.Geometry, Mass=Slider(100, range=0..100), Velocity=vec2pt.Vector)
kangaroo = KangarooPhysics(
    ForceObjects=[plaw_2, plaw, plaw_3, particle_3, particle_2, particle],
    Settings=kangaroo_settings,
    SimulationReset=button)  # -> Out, Iterations, ParticlesOut, GeometryOut, KE
sift_2 = SiftPattern(List=kangaroo.ParticlesOut, SiftPattern=[0, 1, 2])  # -> Output0, Output1, Output2
T = Trail(Points=kangaroo.ParticlesOut, Reset=button, Record=True)
pt_10 = Point(kangaroo.ParticlesOut)
clean_19 = CleanTree(RemoveNulls=True, RemoveInvalid=True, RemoveEmpty=False, Tree=sift_2.Output0)
clean_20 = CleanTree(RemoveNulls=True, RemoveInvalid=True, RemoveEmpty=False, Tree=sift_2.Output2)
clean_21 = CleanTree(RemoveNulls=True, RemoveInvalid=True, RemoveEmpty=False, Tree=sift_2.Output1)
smoothpline = SmoothPolyline(Polyline=T, Strength=1, Times=1)
pdecon = Deconstruct(Point=clean_19)  # -> XComponent, YComponent, ZComponent
pdecon_2 = Deconstruct(Point=clean_20)  # -> XComponent, YComponent, ZComponent
pdecon_3 = Deconstruct(Point=clean_21)  # -> XComponent, YComponent, ZComponent
number_slider_2 = Slider(30000, range=0..30000)
swatch = ColourSwatch(SwatchColor=RGB(51, 209, 245))
swatch_2 = ColourSwatch(SwatchColor=RGB(51, 245, 77))
swatch_3 = ColourSwatch(SwatchColor=RGB(255, 255, 255))
item_2 = ListItem(List=smoothpline, Index=1, Wrap=True)
item_3 = ListItem(List=smoothpline, Index=0, Wrap=True)
item_4 = ListItem(List=pt_10, Index=1, Wrap=True)
item_5 = ListItem(List=smoothpline, Index=2, Wrap=True)
item_6 = ListItem(List=pt_10, Index=0, Wrap=True)
item_7 = ListItem(List=pt_10, Index=2, Wrap=True)
eval = Evaluate(F="Format(\"{0:0.00}\",x)", x=pdecon.YComponent)
eval_2 = Evaluate(F="Format(\"{0:0.00}\",x)", x=pdecon.XComponent)
eval_3 = Evaluate(F="Format(\"{0:0.00}\",x)", x=pdecon.ZComponent)
eval_4 = Evaluate(F="Format(\"{0:0.00}\",x)", x=pdecon_2.YComponent)
eval_5 = Evaluate(F="Format(\"{0:0.00}\",x)", x=pdecon_3.YComponent)
eval_6 = Evaluate(F="Format(\"{0:0.00}\",x)", x=pdecon_2.XComponent)
eval_7 = Evaluate(F="Format(\"{0:0.00}\",x)", x=pdecon_3.XComponent)
eval_8 = Evaluate(F="Format(\"{0:0.00}\",x)", x=pdecon_2.ZComponent)
eval_9 = Evaluate(F="Format(\"{0:0.00}\",x)", x=pdecon_3.ZComponent)
toggle = BooleanToggle(True)
sph = Sphere(Base=item_4, Radius=Slider(1000000, range=0..1000000))
sph_2 = Sphere(Base=item_6, Radius=Slider(1000000, range=0..1000000))
sph_3 = Sphere(Base=item_7, Radius=Slider(1000000, range=0..1000000))
previewlw = CustomPreviewLineweights(Geometry=item_3, Shader=swatch, Thickness=number_slider_2, Absolute=toggle)
previewlw_2 = CustomPreviewLineweights(Geometry=item_2, Shader=swatch_2, Thickness=number_slider_2, Absolute=toggle)
previewlw_3 = CustomPreviewLineweights(Geometry=item_5, Shader=swatch_3, Thickness=number_slider_2, Absolute=toggle)
concat_6 = Concatenate(FragmentA=eval_2, FragmentB=",", FragmentC=eval, FragmentD=",", FragmentE=eval_3)
concat_7 = Concatenate(FragmentA=eval_6, FragmentB=",", FragmentC=eval_4, FragmentD=",", FragmentE=eval_8)
concat_8 = Concatenate(FragmentA=eval_7, FragmentB=",", FragmentC=eval_5, FragmentD=",", FragmentE=eval_9)
concat_9 = Concatenate(FragmentA=concat_6, FragmentB=",", FragmentC=concat_8, FragmentD=",", FragmentE=concat_7)
preview = CustomPreview(Geometry=sph_3, Material=swatch_3)
preview_2 = CustomPreview(Geometry=sph_2, Material=swatch)
preview_3 = CustomPreview(Geometry=sph, Material=swatch_2)
concat_10 = Concatenate(
    FragmentA="A1",
    FragmentB=",",
    FragmentC="A2",
    FragmentD=",",
    FragmentE="A3",
    FragmentF=",",
    FragmentG="B1",
    FragmentH=",",
    FragmentI="B2",
    FragmentJ=",",
    FragmentK="B3",
    FragmentL=",",
    FragmentM="C1",
    FragmentN=",",
    FragmentO="C2",
    FragmentP=",",
    FragmentQ="C3")
concat_11 = Concatenate(FragmentC="C:\Users\KarlRoesch\physVLA\3body", FragmentD="\", FragmentA="3bodyout", FragmentB=".csv")
merge_2 = Merge(Data1=concat_10, Data2=concat_9)  # -> flatten(Result)
text_data_2 = Text(flatten(merge_2))
path_2 = FilePath(concat_11)
panel_11 = Panel(merge_2)
txtwriter_2 = VBScript(filePath=path_2, data=text_data_2, append=Toggle(True), activate=Toggle(True), clearFile=Toggle(False))  # -> out, A; inputs data: list; same code as txtwriter
