# Grasshopper definition bsw-3test.gh (Grasshopper 1.0.7)
# plug-ins: Human

panel = Panel("""0 is even
1 is odd""")
pt = ConstructPoint(XCoordinate=0, YCoordinate=0, ZCoordinate=0)
ellipse = Ellipse(Plane=pt, Radius1=Slider(10, range=0..10), Radius2=Slider(5, range=0..10))  # -> Ellipse, Focus1, Focus2
dom = ConstructDomain(DomainStart=Slider(0, range=-60..10), DomainEnd=Slider(10, range=-60..100))
Z = UnitZ(Factor=Slider(-1, range=-10..10))
dom_2 = ConstructDomain(DomainStart=Slider(0, range=-60..10), DomainEnd=Slider(10, range=-60..100))
move = Move(Geometry=ellipse.Ellipse, Motion=Z)  # -> Geometry, Transform
dom_3 = ConstructDomain(DomainStart=Slider(10, range=-60..100), DomainEnd=Slider(69, range=-60..100))
dom_4 = ConstructDomain(DomainStart=Slider(10, range=-60..100), DomainEnd=Slider(69, range=-60..100))
dom_5 = ConstructDomain(DomainStart=Slider(0, range=-60..10), DomainEnd=Slider(2, range=-60..10))
dom_6 = ConstructDomain(DomainStart=Slider(0, range=-60..10), DomainEnd=Slider(2, range=-60..10))
divide = DivideCurve(Curve=move.Geometry, Count=Slider(20, range=0..30), Kinks=False)  # -> Points, Tangents, Parameters
dom_7 = ConstructDomain(DomainStart=Slider(0, range=-60..10), DomainEnd=Slider(2, range=-60..10))
dom_8 = ConstructDomain(DomainStart=Slider(0, range=-60..10), DomainEnd=Slider(2, range=-60..10))
dispatch = Dispatch(List=divide.Points, DispatchPattern=[True, False])  # -> ListA, ListB
dispatch_2 = Dispatch(List=divide.Points, DispatchPattern=[True, False])  # -> ListA, ListB
dom_9 = ConstructDomain(DomainStart=Slider(-10, range=-60..10), DomainEnd=Slider(-60, range=-60..10))
panel_2 = Panel("WAVE 2 mesh vertices, mesh faces, mesh gradient color code, mesh normal direction,  mesh color randomized depth value calculator")
dom_10 = ConstructDomain(DomainStart=Slider(-10, range=-60..10), DomainEnd=Slider(-60, range=-60..10))
panel_3 = Panel("WAVE 1 mesh vertices, mesh faces, mesh gradient color code, mesh normal direction,  mesh color randomized depth value calculator")
Z_2 = UnitZ(Factor=Slider(-9, range=-10..10))
Z_3 = UnitZ(Factor=Slider(-9, range=-10..10))
panel_4 = Panel("initial conditions")
panel_5 = Panel("testresults")
current_time_format = CurrentTimeFormat(f="%d-%H-%M-%S")  # -> d
# ---------- current_time_format: Python ----------
"""Provides a scripting component.
    Inputs:
        f: date format
    Output:
        d: the date"""

__author__ = "Corsair One"
__version__ = "2019.06.13"

import rhinoscriptsyntax as rs

from datetime import datetime
d = datetime.now().strftime(f)
# ---------- end current_time_format ----------
panel_6 = Panel(current_time_format)
concat = Concatenate(
    FragmentC="C:\Users\KarlRoesch\physVLA\Birch",
    FragmentD="\",
    FragmentA="birchoutinitialconditions",
    FragmentE=panel_6,
    FragmentB=".csv")
path = FilePath(concat)
previewlw = CustomPreviewLineweights(
    Geometry=ellipse.Ellipse,
    Shader=ColourSwatch(SwatchColor=RGB(255, 255, 255)),
    Thickness=Slider(0.25, range=0..2),
    Absolute=True)
panel_7 = Panel("Wave 1 Mesh gradient center of face distance and angle to corresponding wave 2 mesh gradient center of face")

# ---- group: PRESS PLAY - IT AUTO EXPORTS AT 30' - PRESS STOP
trigger = Trigger(Interval=20, TimerInterval=20, Target=[panel, current_time_format, python])  # disabled
python = GhPythonScript()  # -> a
# ---------- python: Python ----------
from ghpythonlib.componentbase import executingcomponent as component
import Grasshopper, GhPython
import System
import Rhino
import rhinoscriptsyntax as rs

T = 0

class MyComponent(component):
    
    def RunScript(self, ):
        global T
                
        T += 1
        
        return T
# ---------- end python ----------

# ----
data = Data(python)

# ---- group: WHEN REACHES 30 PRESS STOP
panel_8 = Panel(data)

# ----
mod = Modulus(A=data, B="2")
num = Number(data)
panel_9 = Panel(mod)
random = Random(Range=dom, Number=1, Seed=num)
random_2 = Random(Range=dom_2, Number=1, Seed=num)
random_3 = Random(Range=dom_3, Number=1, Seed=num)
random_4 = Random(Range=dom_4, Number=1, Seed=num)
random_5 = Random(Range=dom_5, Number=1, Seed=random)  # -> flatten(Random)
random_6 = Random(Range=dom_6, Number=1, Seed=random_2)  # -> flatten(Random)
expression = Expression(x=mod, y="True", z="False", Expression="If(x=1,y,z)")
expression_2 = Expression(x=mod, y="True", z="False", Expression="If(x=0,y,z)")
random_7 = Random(Range=dom_7, Number=1, Seed=random_3)  # -> flatten(Random)
expression_3 = Expression(x=mod, y="True", z="False", Expression="If(x=1,y,z)")
expression_4 = Expression(x=mod, y="True", z="False", Expression="If(x=0,y,z)")
random_8 = Random(Range=dom_8, Number=1, Seed=random_4)  # -> flatten(Random)
bool = Boolean(expression_2)
bool_2 = Boolean(expression_4)
bool_3 = Boolean(expression)
bool_4 = Boolean(expression_3)
panel_10 = Panel(bool)
panel_11 = Panel(bool_3)
panel_12 = Panel(bool_2)
panel_13 = Panel(bool_4)
panel_14 = Panel(random_7)
panel_15 = Panel(random_8)
rep = ReplaceText(Text=panel_10, Find="True", Replace=flatten(panel_14), RecursiveReplace=False)
rep_2 = ReplaceText(Text=panel_12, Find="True", Replace=flatten(panel_15), RecursiveReplace=False)
panel_16 = Panel(bool)
panel_17 = Panel(bool_2)
panel_18 = Panel(random_5)
panel_19 = Panel(random_6)
num_2 = Number(rep)
num_3 = Number(rep_2)
rep_3 = ReplaceText(Text=panel_11, Find="True", Replace=flatten(panel_18), RecursiveReplace=False)
rep_4 = ReplaceText(Text=panel_13, Find="True", Replace=flatten(panel_19), RecursiveReplace=False)
Z_4 = UnitZ(Factor=num_2)
Z_5 = UnitZ(Factor=num_3)
num_4 = Number(rep_3)
num_5 = Number(rep_4)
Z_6 = UnitZ(Factor=num_4)
Z_7 = UnitZ(Factor=num_5)
move_2 = Move(Geometry=dispatch.ListB, Motion=Z_7)  # -> Geometry, Transform
move_3 = Move(Geometry=dispatch.ListA, Motion=Z_5)  # -> Geometry, Transform
move_4 = Move(Geometry=dispatch_2.ListA, Motion=Z_6)  # -> Geometry, Transform
move_5 = Move(Geometry=dispatch_2.ListB, Motion=Z_4)  # -> Geometry, Transform
concat_2 = Concatenate(FragmentA="0", FragmentB=",", FragmentC=panel_19)
concat_3 = Concatenate(FragmentA="0", FragmentB=",", FragmentC=panel_15)
concat_4 = Concatenate(FragmentA="0", FragmentB=",", FragmentC=panel_18)
concat_5 = Concatenate(FragmentA="0", FragmentB=",", FragmentC=panel_14)
item = ListItem(List=move_4.Geometry, Index=Slider(0, range=0..10), Wrap=True)
merge = Merge(Data1=concat_5, Data2=concat_4)
merge_2 = Merge(Data1=concat_3, Data2=concat_2)
item_2 = ListItem(List=move_3.Geometry, Index=Slider(0, range=0..10), Wrap=True)
merge_3 = Merge(Data1=move_4.Geometry, Data2=item)
merge_4 = Merge(Data1=move_3.Geometry, Data2=item_2)
random_9 = Random(Range=dom_9, Number=1, Seed=num)
random_10 = Random(Range=dom_10, Number=1, Seed=num)
weave = Weave(Pattern=[0, 1], Stream0=merge_4, Stream1=move_2.Geometry, NullGaps=False)
weave_2 = Weave(Pattern=[0, 1], Stream0=merge_3, Stream1=move_5.Geometry, NullGaps=False)
intcrv = Interpolate(Vertices=weave, Degree=3, Periodic=False, KnotStyle=1)  # -> Curve, Length, Domain
Z_8 = UnitZ(Factor=random_9)
Z_9 = UnitZ(Factor=random_10)
intcrv_2 = Interpolate(Vertices=weave_2, Degree=3, Periodic=False, KnotStyle=1)  # -> Curve, Length, Domain
move_6 = Move(Geometry=move.Geometry, Motion=Z_8)  # -> Geometry, Transform
extr = Extrude(Base=intcrv.Curve, Direction=Z_2)
move_7 = Move(Geometry=move.Geometry, Motion=Z_9)  # -> Geometry, Transform
extr_2 = Extrude(Base=intcrv_2.Curve, Direction=Z_3)
area = Area(Geometry=move_6.Geometry)  # -> Area, Centroid
mesh = Mesh(extr)
area_2 = Area(Geometry=move_7.Geometry)  # -> Area, Centroid
mesh_2 = Mesh(extr_2)
demesh = DeconstructMesh(Mesh=mesh)  # -> Vertices, Faces, Colours, Normals
demesh_2 = DeconstructMesh(Mesh=mesh_2)  # -> Vertices, Faces, Colours, Normals
dist = Distance(PointA=demesh.Vertices, PointB=area.Centroid)
dist_2 = Distance(PointA=demesh_2.Vertices, PointB=area_2.Centroid)
bnd = Bounds(Numbers=dist)
bnd_2 = Bounds(Numbers=dist_2)
dedomain = DeconstructDomain(Domain=bnd)  # -> Start, End
dedomain_2 = DeconstructDomain(Domain=bnd_2)  # -> Start, End
gradient = Gradient(
    LowerLimit=dedomain.Start,
    UpperLimit=dedomain.End,
    Parameter=dist,
    stops=[0: RGB(243, 57, 0), 0.1: RGB(236, 27, 60), 0.2: RGB(210, 0, 118), 0.3: RGB(103, 0, 120), 0.4: RGB(39, 72, 161), 0.5: RGB(1, 192, 229), 0.6: RGB(18, 178, 90), 0.7: RGB(79, 186, 8), 0.8: RGB(220, 237, 32), 0.9: RGB(247, 159, 20), 1: RGB(243, 57, 0)])
expression_5 = Expression(x=data, y="True", z="False", Expression="If(x=30,y,z)")
gradient_2 = Gradient(
    LowerLimit=dedomain_2.Start,
    UpperLimit=dedomain_2.End,
    Parameter=dist_2,
    stops=[0: RGB(243, 57, 0), 0.1: RGB(236, 27, 60), 0.2: RGB(210, 0, 118), 0.3: RGB(103, 0, 120), 0.4: RGB(39, 72, 161), 0.5: RGB(1, 192, 229), 0.6: RGB(18, 178, 90), 0.7: RGB(79, 186, 8), 0.8: RGB(220, 237, 32), 0.9: RGB(247, 159, 20), 1: RGB(243, 57, 0)])
bool_5 = Boolean(expression_5)
conmesh = ConstructMesh(Vertices=demesh.Vertices, Faces=demesh.Faces, Colours=gradient)  # -> flatten(Mesh)
previewlw_2 = CustomPreviewLineweights(
    Geometry=intcrv_2.Curve,
    Shader=ColourSwatch(SwatchColor=RGB(51, 194, 255)),
    Thickness=Slider(0.25, range=0..2),
    Absolute=True)
previewlw_3 = CustomPreviewLineweights(
    Geometry=intcrv.Curve,
    Shader=ColourSwatch(SwatchColor=RGB(0, 255, 81)),
    Thickness=Slider(0.25, range=0..2),
    Absolute=True)
conmesh_2 = ConstructMesh(Vertices=demesh_2.Vertices, Faces=demesh_2.Faces, Colours=gradient_2)  # -> flatten(Mesh)
panel_20 = Panel(area.Centroid)
demesh_3 = DeconstructMesh(Mesh=conmesh)  # -> Vertices, Faces, Colours, Normals
panel_21 = Panel(area_2.Centroid)
demesh_4 = DeconstructMesh(Mesh=conmesh_2)  # -> Vertices, Faces, Colours, Normals
concat_6 = Concatenate(
    FragmentA=demesh_3.Vertices,
    FragmentB=",",
    FragmentC=demesh_3.Faces,
    FragmentD=",",
    FragmentE=demesh_3.Colours,
    FragmentF=",",
    FragmentG=demesh_3.Normals,
    FragmentH=",",
    FragmentI=panel_20)
concat_7 = Concatenate(
    FragmentA=demesh_4.Vertices,
    FragmentB=",",
    FragmentC=demesh_4.Faces,
    FragmentD=",",
    FragmentE=demesh_4.Colours,
    FragmentF=",",
    FragmentG=demesh_4.Normals,
    FragmentH=",",
    FragmentI=panel_21)

# ---- group: PRESS PLAY - IT AUTO EXPORTS AT 30' - PRESS STOP (continued)
rec = DataRecorder(concat_6, DataLimit=-10, RecordData=True)
rec_2 = DataRecorder(concat_7, DataLimit=-10, RecordData=True)

# ----
merge_5 = Merge(Data1=panel_2, Data2=rec_2)  # -> flatten(Result)
merge_6 = Merge(Data1=panel_3, Data2=rec)  # -> flatten(Result)
panel_22 = Panel(merge_5)
angle = Angle(VectorA=demesh_3.Vertices, VectorB=demesh_4.Vertices)  # -> Angle, Reflex
dist_3 = Distance(PointA=demesh_3.Vertices, PointB=demesh_4.Vertices)
panel_23 = Panel(concat_6)
deg = Degrees(Radians=angle.Angle)
panel_24 = Panel(concat_7)
concat_8 = Concatenate(FragmentA=dist_3, FragmentB=",", FragmentC=deg)
merge_7 = Merge(Data1=panel_7, Data2=concat_8)  # -> flatten(Result)
merge_8 = Merge(
    Data1=ellipse.Ellipse,
    Data2=pt,
    Data3=ellipse.Focus1,
    Data4=ellipse.Focus2,
    Data5="WAVE 1 oscillation values",
    Data6=merge_2,
    Data7="WAVE 2 oscillation values",
    Data8=merge,
    Data9="wave oscillation base points",
    Data10=dispatch.ListA,
    Data11=dispatch.ListB,
    Data12=merge_7)  # -> flatten(Result)
panel_25 = Panel(merge_8)
merge_9 = Merge(Data1=merge_8, Data2=merge_6, Data3=merge_5)
text_data = Text(flatten(merge_9))
txtwriter = VBScript(filePath=path, data=text_data, append=Toggle(False), activate=bool_5, clearFile=Toggle(False))  # -> out, A; inputs data: list
# ---------- txtwriter: VB usings ----------
Imports System.IO
Imports System.Linq
Imports System.Data
Imports System.Drawing
Imports System.Reflection
Imports System.Windows.Forms
Imports System.Xml
Imports System.Xml.Linq
Imports Microsoft.VisualBasic
Imports System.Runtime.InteropServices

Imports Rhino.DocObjects
Imports Rhino.Collections
Imports GH_IO
Imports GH_IO.Serialization
# ---------- txtwriter: VB ----------
    If activate Then

      Dim i As Integer
      Dim aryText(4) As String

      aryText(0) = "True"
      aryText(1) = "Had"
      aryText(2) = "Another"
      aryText(3) = "Little"
      aryText(4) = "One"

      ' the data is appended to the file. If file doesnt exist, a new file is created
      Dim objWriter As New System.IO.StreamWriter(filePath, append)

      For i = 0 To data.Count - 1
        objWriter.WriteLine(data(i))
      Next

      objWriter.Close()
      
      A = aryText(0)

    End If

    If clearFile Then
      Dim objWriter As New System.IO.StreamWriter(filePath, False)
      objWriter.Close()
    End If
# ---------- end txtwriter ----------
panel_26 = Panel(merge_9)
panel_27 = Panel(merge_7)
