# Grasshopper definition wavewalls4.gh (Grasshopper 1.0.7)
# plug-ins: Human, LunchBox, Pufferfish

python = GhPythonScript(x="C:\Users\KarlRoesch\physVLA\wavetheory\waveaipred")  # -> out, flatten(a)
# ---------- python: Python ----------
__author__ = "peychev"
__version__ = "2018.08.27"

import rhinoscriptsyntax as rs

from System.IO import Directory, Path, SearchOption

#a = Directory.GetDirectories(x)

a = Directory.GetFiles(x)

#a = Directory.GetFiles(x,"*",SearchOption.AllDirectories)
# ---------- end python ----------
item = ListItem(List=python.a, Index=Slider(1, range=0..10), Wrap=True)
file = ReadFile(File=item, PerLineParse=True)
clean = CleanTree(RemoveNulls=True, RemoveInvalid=True, RemoveEmpty=True, Tree=file)  # -> flatten(Tree)
panel = Panel(clean)
panel_2 = Panel(python.a)
replace = ReplaceMembers(Set=clean, Replace="WALL")
mindex = MemberIndex(Set=replace, Member="WALL")  # -> Index, Count
cull_i = CullIndex(List=clean, Indices=mindex.Index, Wrap=True)  # -> flatten(List)
mindex_2 = MemberIndex(Set=cull_i, Member="Plane_ID,Type,Point_Index,X,Y,Z")  # -> Index, Count
split = SplitList(List=clean, Index=Slider(1, range=0..1))  # -> flatten(ListA), ListB
tmatch = MatchText(Text=split.ListB, Pattern="basewall1*", Case=True)
dispatch = Dispatch(List=split.ListB, DispatchPattern=tmatch)  # -> ListA, ListB
split_2 = SplitList(List=dispatch.ListA, Index=Slider(10, range=0..100))  # -> flatten(ListA), ListB
rep = ReplaceText(Text=split_2.ListA, Find="(", Replace="{", RecursiveReplace=False)
panel_3 = Panel(dispatch.ListA)
rep_2 = ReplaceText(Text=rep, Find=")", Replace="}", RecursiveReplace=False)
split_3 = TextSplit(Text=rep_2, Separators=",")
item_2 = ListItem(List=split_3, Index=Slider(2, range=0..10), Wrap=True)  # -> flatten(Item)
item_3 = ListItem(List=split_3, Index=Slider(3, range=0..10), Wrap=True)  # -> flatten(Item)
panel_4 = Panel(split_3)
pt = ConstructPoint(XCoordinate=item_2, YCoordinate=item_3, ZCoordinate=0)  # -> flatten(Point)
division = Division(A=Slider(6.25, range=0..10), B=Slider(12, range=0..100))
division_2 = Division(A=Slider(4.167, range=0..10), B=Slider(12, range=0..100))
division_3 = Division(A=Slider(4.167, range=0..10), B=Slider(12, range=0..100))
division_4 = Division(A=Slider(6.25, range=0..10), B=Slider(12, range=0..100))
division_5 = Division(A=Slider(6.25, range=0..10), B=Slider(12, range=0..100))
pt_2 = ConstructPoint(XCoordinate=0, YCoordinate=0, ZCoordinate=0)
pt_3 = ConstructPoint(XCoordinate=division_2, YCoordinate=0, ZCoordinate=0)
pt_4 = ConstructPoint(XCoordinate=0, YCoordinate=division_4, ZCoordinate=0)
pt_5 = ConstructPoint(XCoordinate=division_3, YCoordinate=division_5, ZCoordinate=0)
trigger = Trigger(Interval=200, TimerInterval=200, Target=[lng, python_2, num, file_2, python_3])  # disabled
pline = PolyLine(Vertices=[pt_2, pt_3, pt_5, pt_4], Closed=True)
button = Button()
area = Area(Geometry=pline)  # -> Area, Centroid
python_2 = GhPythonScript(x="C:\Users\KarlRoesch\physVLA\wavetheory\waveana")  # -> out, flatten(a); same code as python
lng = ListLength(List=python_2.a)
number_slider = Slider(0.2, range=0..1)  # disabled
number_slider_2 = Slider(2, range=0..10)  # disabled
button_2 = Button()  # disabled
button_3 = Button()  # disabled
num = Number(lng)
addition = Addition(A=num, B=Slider(80, range=0..100))
python_3 = GhPythonScript(x="C:\Users\KarlRoesch\physVLA\wavetheory\waveaipred")  # -> out, flatten(a); same code as python
division_6 = Division(A=number_slider, B=number_slider_2)  # disabled

# ----
# Unfold Triangulated Surfaces
# Andrew Heumann 2011
# http://heumanndesigntech.wordpress.com
# Calculates a triangulated version of an input surface, divides it into strips along the U or V, and then unfolds the resulting strips into flat patterns for fabrication.
image = ImageSampler(Filter="Colour", Interpolate=False, Umax=1, Umin=0, Vmax=1, Vmin=0, Wrap=1)

file_2 = ReadFile(File=python_3.a, PerLineParse=True)
clean_2 = CleanTree(RemoveNulls=True, RemoveInvalid=True, RemoveEmpty=True, Tree=file_2)
ellipse = Ellipse(Plane=PlaneXY(0, 0, 0), Radius1=number_slider, Radius2=division_6)  # -> Ellipse, Focus1, Focus2; disabled
number_slider_3 = Slider(2, range=0..10)  # disabled
number_slider_4 = Slider(-0.01, range=-1..1)  # disabled
panel_5 = Panel("1 to 1000")  # disabled
panel_6 = Panel("BoundingBoxDimW;BoundingBoxDimH;BoundingBoxBottomLeftPoint; BoundingBoxBottomRightPoint;BoundingBoxUpperLeftPoint;BoundingBoxupperrightpoint")  # disabled
panel_7 = Panel(".005")  # disabled
swatch = ColourSwatch(SwatchColor=RGB(255, 255, 255))  # disabled
replace_2 = ReplaceMembers(Set=clean_2, Replace="WALL")
multiplication = Multiplication(A=number_slider_4, B=number_slider_3)  # disabled
panel_8 = Panel("True")  # disabled
panel_9 = Panel("False")  # disabled
panel_10 = Panel("-0.1 to 0.1")  # disabled
number_slider_5 = Slider(30, range=0..100)  # disabled
offset = OffsetCurve(Curve=ellipse.Ellipse, Distance=number_slider_4, Corners=1)  # disabled
offset_2 = OffsetCurve(Curve=ellipse.Ellipse, Distance=multiplication, Corners=1)  # disabled
dist = Distance(PointA=pt_2, PointB=pt_4)  # disabled
dist_2 = Distance(PointA=pt_2, PointB=pt_3)  # disabled
previewlw = CustomPreviewLineweights(Geometry=pline, Shader=swatch, Thickness=panel_7, Absolute=True)  # disabled
number_slider_6 = Slider(3, range=0..10)  # disabled
expression = Expression(x=addition, y=panel_8, z=panel_9, Expression="if(x≠0,y,z)")  # disabled
mindex_3 = MemberIndex(Set=replace_2, Member="WALL")  # -> Index, Count
panel_11 = Panel(";")  # disabled
random = Random(Range=panel_5, Number=1, Seed=addition)  # disabled
rectangle = Rectangle(Plane=area.Centroid, XSize=panel_10, YSize=panel_10, Radius=0)  # -> Rectangle, Length; disabled
panel_12 = Panel("")  # disabled
panel_13 = Panel("OUTERWALL")  # disabled
divide = DivideCurve(Curve=offset_2, Count=number_slider_5, Kinks=False)  # -> Points, Tangents, Parameters; disabled
divide_2 = DivideCurve(Curve=offset, Count=number_slider_5, Kinks=False)  # -> Points, Tangents, Parameters; disabled
cull_i_2 = CullIndex(List=file_2, Indices=mindex_3.Index, Wrap=True)  # -> flatten(List)
pop2d = Populate2D(Region=rectangle.Rectangle, Count=number_slider_6, Seed=random)  # disabled
panel_14 = Panel("INNERWALL")  # disabled
intcrv = Interpolate(Vertices=pop2d, Degree=3, Periodic=False, KnotStyle=1)  # -> Curve, Length, Domain; disabled
panel_15 = Panel(".005")  # disabled
pdecon = Deconstruct(Point=cull_i_2)  # -> XComponent, YComponent, ZComponent; disabled
swatch_2 = ColourSwatch(SwatchColor=RGB(255, 0, 255))  # disabled
concat = Concatenate(
    FragmentJ=dist_2,
    FragmentI=panel_11,
    FragmentH=dist,
    FragmentK=panel_11,
    FragmentA=pt_2,
    FragmentB=panel_11,
    FragmentC=pt_3,
    FragmentD=panel_11,
    FragmentE=pt_4,
    FragmentF=panel_11,
    FragmentG=pt_5)  # disabled
pt_6 = ConstructPoint(XCoordinate=pdecon.XComponent, YCoordinate=pdecon.YComponent, ZCoordinate=0)  # disabled
divide_3 = DivideCurve(Curve=intcrv.Curve, Count=30, Kinks=False)  # -> Points, Tangents, Parameters; disabled
panel_16 = Panel("{")  # disabled
panel_17 = Panel("(")  # disabled
intcrv_2 = Interpolate(Vertices=pt_6, Degree=3, Periodic=False, KnotStyle=1)  # -> Curve, Length, Domain; disabled
rep_3 = ReplaceText(Text=concat, Find=panel_16, Replace=panel_17, RecursiveReplace=False)  # disabled
previewlw_2 = CustomPreviewLineweights(Geometry=intcrv.Curve, Shader=swatch_2, Thickness=panel_15, Absolute=True)  # disabled
panel_18 = Panel("AIGENOUTERWALL")  # disabled
merge = Merge(Data1=panel_13, Data2=divide_3.Points)  # -> flatten(Result); disabled
panel_19 = Panel("}")  # disabled
panel_20 = Panel("{")  # disabled
panel_21 = Panel(")")  # disabled
panel_22 = Panel("(")  # disabled
divide_4 = DivideCurve(Curve=intcrv_2.Curve, Count=30, Kinks=False)  # -> Points, Tangents, Parameters; disabled
swatch_3 = ColourSwatch(SwatchColor=RGB(0, 255, 106))  # disabled
panel_23 = Panel(".01")  # disabled
rep_4 = ReplaceText(Text=rep_3, Find=panel_19, Replace=panel_21, RecursiveReplace=False)  # disabled
rep_5 = ReplaceText(Text=merge, Find=panel_20, Replace=panel_22, RecursiveReplace=False)  # disabled
Y = UnitY(Factor=Slider(0.25, range=-0.25..0.25))
panel_24 = Panel("}")  # disabled
panel_25 = Panel(")")  # disabled
ln = Line(StartPoint=pt_2, EndPoint=pt_3)
pt_7 = Point(area.Centroid)
panel_26 = Panel("configtest")  # disabled
midpt = CurveMiddle(Curve=ln)  # disabled
end = EndPoints(Curve=ln)  # -> Start, End; disabled
move = Move(Geometry=pt_7, Motion=Y)  # -> Geometry, Transform; disabled
rep_6 = ReplaceText(Text=rep_5, Find=panel_24, Replace=panel_25, RecursiveReplace=False)  # disabled
merge_2 = Merge(Data1=panel_6, Data2=rep_4, Data3=rep_6)  # disabled
panel_27 = Panel(merge_2)  # disabled
merge_3 = Merge(Data1=panel_18, Data2=divide_4.Points)  # -> flatten(Result); disabled
previewlw_3 = CustomPreviewLineweights(Geometry=intcrv_2.Curve, Shader=swatch_3, Thickness=panel_23, Absolute=True)  # disabled
panel_28 = Panel("returntest")  # disabled
panel_29 = Panel("C:\Users\KarlRoesch\physVLA\wavetheory\wavein")  # disabled
number_slider_7 = Slider(10, range=0..100)  # disabled
yz = YZPlane(Origin=end.Start)  # disabled
intcrv_3 = Interpolate(Vertices=[end.Start, move.Geometry, end.End], Degree=3, Periodic=False, KnotStyle=1)  # -> Curve, Length, Domain; disabled
Y_2 = UnitY(Factor=Slider(0.25, range=-0.25..0.25))
ln_2 = Line(StartPoint=pt_2, EndPoint=pt_3)
pt_8 = Point(area.Centroid)
panel_30 = Panel(".01")  # disabled
swatch_4 = ColourSwatch(SwatchColor=RGB(0, 208, 255))  # disabled
toggle = BooleanToggle(False)  # disabled
midpt_2 = CurveMiddle(Curve=ln_2)
end_2 = EndPoints(Curve=ln_2)  # -> Start, End
move_2 = Move(Geometry=pt_8, Motion=Y_2)  # -> Geometry, Transform
panel_31 = Panel("\")  # disabled
panel_32 = Panel(".txt")  # disabled
panel_33 = Panel("C:\Users\KarlRoesch\physVLA\wavetheory\wavein")  # disabled
arrpolar = PolarArray(Geometry=intcrv_3.Curve, Plane=yz, Count=number_slider_7, Angle=6.283185307)  # -> Geometry, Transform; disabled
concat_2 = Concatenate(FragmentC=panel_29, FragmentD=panel_31, FragmentA=panel_28, FragmentE=addition, FragmentB=panel_32)  # disabled
toggle_2 = BooleanToggle(False)  # disabled
text_data = Text(flatten(merge_3))  # disabled
previewlw_4 = CustomPreviewLineweights(Geometry=intcrv_3.Curve, Shader=swatch_4, Thickness=panel_30, Absolute=True)  # disabled
graft = GraftTree(Tree=arrpolar.Geometry, IncludeEmptyLists=True, IncludeNullItems=True)  # disabled
yz_2 = YZPlane(Origin=end_2.Start)
intcrv_4 = Interpolate(Vertices=[end_2.Start, move_2.Geometry, end_2.End], Degree=3, Periodic=False, KnotStyle=1)  # -> Curve, Length, Domain
toggle_3 = BooleanToggle(False)  # disabled
panel_34 = Panel("\")  # disabled
panel_35 = Panel("basewall1BoundingBoxPlaneOrigin;basewall1BoundingBoxPlaneAxisvectorsZ;basewall1BoundingBox(DimX1,DimX2)basewall1BoundingBox(DimY1,DimY2);basewall1BoundingBoxDimV;basewall1BoundingBoxBottomPoint1;basewall1BoundingBoxBottomPoint2;basewall1BoundingBoxBottomPoint3;basewall1BoundingBoxBottomPoint4;basewall1BoundingBoxvectordirection")  # disabled
panel_36 = Panel("basewall2BoundingBoxPlaneOrigin;basewall2BoundingBoxPlaneAxisvectorsZ;basewall2BoundingBox(DimX1,DimX2)basewall2BoundingBox(DimY1,DimY2);basewall2BoundingBoxDimV;basewall2BoundingBoxBottomPoint1;basewall2BoundingBoxBottomPoint2;basewall2BoundingBoxBottomPoint3;basewall2BoundingBoxBottomPoint4;basewall2BoundingBoxvectordirection")  # disabled
panel_37 = Panel(".txt")  # disabled
path = FilePath(concat_2)  # disabled
bang = ExplodeTree(Data=graft)  # -> Branch0, Branch1, Branch2, Branch3, Branch4, Branch5, Branch6, Branch7, Branch8, Branch9; disabled
panel_38 = Panel("basewall3BoundingBoxPlaneOrigin;basewall3BoundingBoxPlaneAxisvectorsZ;basewall3BoundingBox(DimX1,DimX2)basewall3BoundingBox(DimY1,DimY2);basewall3BoundingBoxDimV;basewall3BoundingBoxBottomPoint1;basewall3BoundingBoxBottomPoint2;basewall3BoundingBoxBottomPoint3;basewall3BoundingBoxBottomPoint4;basewall3BoundingBoxvectordirection")  # disabled
concat_3 = Concatenate(FragmentC=panel_33, FragmentD=panel_34, FragmentA=panel_26, FragmentE=addition, FragmentB=panel_37)  # disabled
toggle_4 = BooleanToggle(False)  # disabled
txtwriter = VBScript(filePath=path, data=text_data, append=toggle, activate=button_3, clearFile=toggle_2)  # -> out, A; inputs data: list; disabled
# ---------- txtwriter: VB usings ----------
Imports System.IO
Imports System.Linq
Imports System.Data
Imports System.Drawing
Imports System.Reflection
Imports System.Windows.Forms
Imports System.Xml
Imports System.Xml.Linq
Imports Microsoft.VisualBasic
Imports System.Runtime.InteropServices

Imports Rhino.DocObjects
Imports Rhino.Collections
Imports GH_IO
Imports GH_IO.Serialization
# ---------- txtwriter: VB ----------
    If activate Then

      Dim i As Integer
      Dim aryText(4) As String

      aryText(0) = "True"
      aryText(1) = "Had"
      aryText(2) = "Another"
      aryText(3) = "Little"
      aryText(4) = "One"

      ' the data is appended to the file. If file doesnt exist, a new file is created
      Dim objWriter As New System.IO.StreamWriter(filePath, append)

      For i = 0 To data.Count - 1
        objWriter.WriteLine(data(i))
      Next

      objWriter.Close()
      
      A = aryText(0)

    End If

    If clearFile Then
      Dim objWriter As New System.IO.StreamWriter(filePath, False)
      objWriter.Close()
    End If
# ---------- end txtwriter ----------
text_data_2 = Text(flatten(merge_2))  # disabled
panel_39 = Panel("basewall4BoundingBoxPlaneOrigin;basewall4BoundingBoxPlaneAxisvectorsZ;basewall4BoundingBox(DimX1,DimX2)basewall4BoundingBox(DimY1,DimY2);basewall4BoundingBoxDimV;basewall4BoundingBoxBottomPoint1;basewall4BoundingBoxBottomPoint2;basewall4BoundingBoxBottomPoint3;basewall4BoundingBoxBottomPoint4;basewall4BoundingBoxvectordirection")  # disabled
arrpolar_2 = PolarArray(Geometry=intcrv_4.Curve, Plane=yz_2, Count=Slider(10, range=0..100), Angle=6.283185307)  # -> Geometry, Transform
panel_40 = Panel("basewall5BoundingBoxPlaneOrigin;basewall5BoundingBoxPlaneAxisvectorsZ;basewall5BoundingBox(DimX1,DimX2)basewall5BoundingBox(DimY1,DimY2);basewall5BoundingBoxDimV;basewall5BoundingBoxBottomPoint1;basewall5BoundingBoxBottomPoint2;basewall5BoundingBoxBottomPoint3;basewall5BoundingBoxBottomPoint4;basewall5BoundingBoxvectordirection")  # disabled
panel_41 = Panel("basewall6BoundingBoxPlaneOrigin;basewall6BoundingBoxPlaneAxisvectorsZ;basewall6BoundingBox(DimX1,DimX2)basewall6BoundingBox(DimY1,DimY2);basewall6BoundingBoxDimV;basewall6BoundingBoxBottomPoint1;basewall6BoundingBoxBottomPoint2;basewall6BoundingBoxBottomPoint3;basewall6BoundingBoxBottomPoint4;basewall6BoundingBoxvectordirection")  # disabled
path_2 = FilePath(concat_3)  # disabled
panel_42 = Panel("basewall8BoundingBoxPlaneOrigin;basewall8BoundingBoxPlaneAxisvectorsZ;basewall8BoundingBox(DimX1,DimX2)basewall8BoundingBox(DimY1,DimY2);basewall8BoundingBoxDimV;basewall8BoundingBoxBottomPoint1;basewall8BoundingBoxBottomPoint2;basewall8BoundingBoxBottomPoint3;basewall8BoundingBoxBottomPoint4;basewall8BoundingBoxvectordirection")  # disabled
panel_43 = Panel("basewall7BoundingBoxPlaneOrigin;basewall7BoundingBoxPlaneAxisvectorsZ;basewall7BoundingBox(DimX1,DimX2)basewall7BoundingBox(DimY1,DimY2);basewall7BoundingBoxDimV;basewall7BoundingBoxBottomPoint1;basewall7BoundingBoxBottomPoint2;basewall7BoundingBoxBottomPoint3;basewall7BoundingBoxBottomPoint4;basewall7BoundingBoxvectordirection")  # disabled
panel_44 = Panel("basewall10BoundingBoxPlaneOrigin;basewall10BoundingBoxPlaneAxisvectorsZ;basewall10BoundingBox(DimX1,DimX2)basewall10BoundingBox(DimY1,DimY2);basewall10BoundingBoxDimV;basewall10BoundingBoxBottomPoint1;basewall10BoundingBoxBottomPoint2;basewall10BoundingBoxBottomPoint3;basewall10BoundingBoxBottomPoint4;basewall10BoundingBoxvectordirection")  # disabled
panel_45 = Panel("basewall9BoundingBoxPlaneOrigin;basewall9BoundingBoxPlaneAxisvectorsZ;basewall9BoundingBox(DimX1,DimX2)basewall9BoundingBox(DimY1,DimY2);basewall9BoundingBoxDimV;basewall9BoundingBoxBottomPoint1;basewall9BoundingBoxBottomPoint2;basewall9BoundingBoxBottomPoint3;basewall9BoundingBoxBottomPoint4;basewall9BoundingBoxvectordirection")  # disabled
graft_2 = GraftTree(Tree=arrpolar_2.Geometry, IncludeEmptyLists=True, IncludeNullItems=True)
previewlw_5 = CustomPreviewLineweights(Geometry=intcrv_4.Curve, Shader=ColourSwatch(SwatchColor=RGB(0, 208, 255)), Thickness=".01", Absolute=True)
txtwriter_2 = VBScript(filePath=path_2, data=text_data_2, append=toggle_3, activate=button_2, clearFile=toggle_4)  # -> out, A; inputs data: list; disabled; same code as txtwriter
divide_5 = DivideCurve(Curve=bang.Branch0, Count=30, Kinks=False)  # -> simplify(flatten(Points)), Tangents, Parameters; disabled
divide_6 = DivideCurve(Curve=bang.Branch1, Count=30, Kinks=False)  # -> simplify(flatten(Points)), Tangents, Parameters; disabled
divide_7 = DivideCurve(Curve=bang.Branch2, Count=30, Kinks=False)  # -> simplify(flatten(Points)), Tangents, Parameters; disabled
divide_8 = DivideCurve(Curve=bang.Branch3, Count=30, Kinks=False)  # -> simplify(flatten(Points)), Tangents, Parameters; disabled
divide_9 = DivideCurve(Curve=bang.Branch5, Count=30, Kinks=False)  # -> simplify(flatten(Points)), Tangents, Parameters; disabled
divide_10 = DivideCurve(Curve=bang.Branch4, Count=30, Kinks=False)  # -> simplify(flatten(Points)), Tangents, Parameters; disabled
divide_11 = DivideCurve(Curve=bang.Branch6, Count=30, Kinks=False)  # -> simplify(flatten(Points)), Tangents, Parameters; disabled
divide_12 = DivideCurve(Curve=bang.Branch7, Count=30, Kinks=False)  # -> simplify(flatten(Points)), Tangents, Parameters; disabled
divide_13 = DivideCurve(Curve=bang.Branch8, Count=30, Kinks=False)  # -> simplify(flatten(Points)), Tangents, Parameters; disabled
divide_14 = DivideCurve(Curve=bang.Branch9, Count=30, Kinks=False)  # -> simplify(flatten(Points)), Tangents, Parameters; disabled
scale_nu = ScaleNU(Geometry=graft_2, Plane=arrpolar_2.Geometry, ScaleX=1, ScaleY=1, ScaleZ=1)  # -> Geometry, Transform
plfit = PlaneFit(Points=divide_5.Points)  # -> Plane, Deviation; disabled
plfit_2 = PlaneFit(Points=divide_6.Points)  # -> Plane, Deviation; disabled
bang_2 = ExplodeTree(Data=graft_2)  # -> Branch0, Branch1, Branch2, Branch3, Branch4, Branch5, Branch6, Branch7, Branch8, Branch9
plfit_3 = PlaneFit(Points=divide_7.Points)  # -> Plane, Deviation; disabled
intcrv_5 = Interpolate(Vertices=divide_5.Points, Degree=3, Periodic=False, KnotStyle=1)  # -> Curve, Length, Domain; disabled
intcrv_6 = Interpolate(Vertices=divide_6.Points, Degree=3, Periodic=False, KnotStyle=1)  # -> Curve, Length, Domain; disabled
bbox = BoundingBox(Content=divide_5.Points, Plane=plfit.Plane, UnionBox=True)  # -> Box, Box_2; disabled
plfit_4 = PlaneFit(Points=divide_8.Points)  # -> Plane, Deviation; disabled
panel_46 = Panel("basewall1BoundingBoxPlaneOrigin;basewall1BoundingBoxPlaneAxisvectorsZ;basewall1BoundingBox(DimX1,DimX2)basewall1BoundingBox(DimY1,DimY2);basewall1BoundingBoxDimV;basewall1BoundingBoxBottomPoint1;basewall1BoundingBoxBottomPoint2;basewall1BoundingBoxBottomPoint3;basewall1BoundingBoxBottomPoint4;basewall1BoundingBoxvectordirection")
bbox_2 = BoundingBox(Content=divide_6.Points, Plane=plfit_2.Plane, UnionBox=True)  # -> Box, Box_2; disabled
area_2 = Area(Geometry=bbox.Box)  # -> Area, Centroid; disabled
panel_47 = Panel("basewall2BoundingBoxPlaneOrigin;basewall2BoundingBoxPlaneAxisvectorsZ;basewall2BoundingBox(DimX1,DimX2)basewall2BoundingBox(DimY1,DimY2);basewall2BoundingBoxDimV;basewall2BoundingBoxBottomPoint1;basewall2BoundingBoxBottomPoint2;basewall2BoundingBoxBottomPoint3;basewall2BoundingBoxBottomPoint4;basewall2BoundingBoxvectordirection")
plfit_5 = PlaneFit(Points=divide_10.Points)  # -> Plane, Deviation; disabled
area_3 = Area(Geometry=bbox_2.Box)  # -> Area, Centroid; disabled
plfit_6 = PlaneFit(Points=divide_9.Points)  # -> Plane, Deviation; disabled
bbox_3 = BoundingBox(Content=divide_7.Points, Plane=plfit_3.Plane, UnionBox=True)  # -> Box, Box_2; disabled
plfit_7 = PlaneFit(Points=divide_12.Points)  # -> Plane, Deviation; disabled
plfit_8 = PlaneFit(Points=divide_11.Points)  # -> Plane, Deviation; disabled
panel_48 = Panel("basewall3BoundingBoxPlaneOrigin;basewall3BoundingBoxPlaneAxisvectorsZ;basewall3BoundingBox(DimX1,DimX2)basewall3BoundingBox(DimY1,DimY2);basewall3BoundingBoxDimV;basewall3BoundingBoxBottomPoint1;basewall3BoundingBoxBottomPoint2;basewall3BoundingBoxBottomPoint3;basewall3BoundingBoxBottomPoint4;basewall3BoundingBoxvectordirection")
plfit_9 = PlaneFit(Points=divide_14.Points)  # -> Plane, Deviation; disabled
area_4 = Area(Geometry=bbox_3.Box)  # -> Area, Centroid; disabled
box_corners = BoxCorners(Box=bbox.Box)  # -> CornerA, CornerB, CornerC, CornerD, CornerE, CornerF, CornerG, CornerH; disabled
plfit_10 = PlaneFit(Points=divide_13.Points)  # -> Plane, Deviation; disabled
panel_49 = Panel("basewall3points")  # disabled
debox = DeconstructBox(Box=bbox.Box)  # -> Plane, X, Y, Z; disabled
panel_50 = Panel("basewall5points")  # disabled
panel_51 = Panel("basewall2points")  # disabled
panel_52 = Panel("basewall4points")  # disabled
panel_53 = Panel("basewall6points")  # disabled
panel_54 = Panel("basewall1points")  # disabled
panel_55 = Panel("basewall8points")  # disabled
panel_56 = Panel(" ")  # disabled
panel_57 = Panel("basewall7points")  # disabled
panel_58 = Panel("basewall9points")  # disabled
panel_59 = Panel("basewall10points")  # disabled
box_corners_2 = BoxCorners(Box=bbox_2.Box)  # -> CornerA, CornerB, CornerC, CornerD, CornerE, CornerF, CornerG, CornerH; disabled
bbox_4 = BoundingBox(Content=divide_8.Points, Plane=plfit_4.Plane, UnionBox=True)  # -> Box, Box_2; disabled
vec2pt = Vector2Pt(PointA=midpt, PointB=area_2.Centroid, Unitize=False)  # -> Vector, Length; disabled
debox_2 = DeconstructBox(Box=bbox_2.Box)  # -> Plane, X, Y, Z; disabled
panel_60 = Panel(" ")  # disabled
panel_61 = Panel("basewall4BoundingBoxPlaneOrigin;basewall4BoundingBoxPlaneAxisvectorsZ;basewall4BoundingBox(DimX1,DimX2)basewall4BoundingBox(DimY1,DimY2);basewall4BoundingBoxDimV;basewall4BoundingBoxBottomPoint1;basewall4BoundingBoxBottomPoint2;basewall4BoundingBoxBottomPoint3;basewall4BoundingBoxBottomPoint4;basewall4BoundingBoxvectordirection")
vec2pt_2 = Vector2Pt(PointA=midpt, PointB=area_3.Centroid, Unitize=False)  # -> Vector, Length; disabled
bbox_5 = BoundingBox(Content=divide_10.Points, Plane=plfit_5.Plane, UnionBox=True)  # -> Box, Box_2; disabled
area_5 = Area(Geometry=bbox_4.Box)  # -> Area, Centroid; disabled
box_corners_3 = BoxCorners(Box=bbox_3.Box)  # -> CornerA, CornerB, CornerC, CornerD, CornerE, CornerF, CornerG, CornerH; disabled
bbox_6 = BoundingBox(Content=divide_9.Points, Plane=plfit_6.Plane, UnionBox=True)  # -> Box, Box_2; disabled
debox_3 = DeconstructBox(Box=bbox_3.Box)  # -> Plane, X, Y, Z; disabled
panel_62 = Panel("basewall5BoundingBoxPlaneOrigin;basewall5BoundingBoxPlaneAxisvectorsZ;basewall5BoundingBox(DimX1,DimX2)basewall5BoundingBox(DimY1,DimY2);basewall5BoundingBoxDimV;basewall5BoundingBoxBottomPoint1;basewall5BoundingBoxBottomPoint2;basewall5BoundingBoxBottomPoint3;basewall5BoundingBoxBottomPoint4;basewall5BoundingBoxvectordirection")
panel_63 = Panel(" ")  # disabled
bbox_7 = BoundingBox(Content=divide_12.Points, Plane=plfit_7.Plane, UnionBox=True)  # -> Box, Box_2; disabled
area_6 = Area(Geometry=bbox_5.Box)  # -> Area, Centroid; disabled
vec2pt_3 = Vector2Pt(PointA=midpt, PointB=area_4.Centroid, Unitize=False)  # -> Vector, Length; disabled
panel_64 = Panel("basewall6BoundingBoxPlaneOrigin;basewall6BoundingBoxPlaneAxisvectorsZ;basewall6BoundingBox(DimX1,DimX2)basewall6BoundingBox(DimY1,DimY2);basewall6BoundingBoxDimV;basewall6BoundingBoxBottomPoint1;basewall6BoundingBoxBottomPoint2;basewall6BoundingBoxBottomPoint3;basewall6BoundingBoxBottomPoint4;basewall6BoundingBoxvectordirection")
dedomain = DeconstructDomain(Domain=debox.X)  # -> Start, End; disabled
dedomain_2 = DeconstructDomain(Domain=debox.Y)  # -> Start, End; disabled
bbox_8 = BoundingBox(Content=divide_11.Points, Plane=plfit_8.Plane, UnionBox=True)  # -> Box, Box_2; disabled
split_4 = TextSplit(Text=debox.Plane, Separators=panel_56)  # disabled
bbox_9 = BoundingBox(Content=divide_14.Points, Plane=plfit_9.Plane, UnionBox=True)  # -> Box, Box_2; disabled
area_7 = Area(Geometry=bbox_9.Box)  # -> Area, Centroid; disabled
area_8 = Area(Geometry=bbox_6.Box)  # -> Area, Centroid; disabled
panel_65 = Panel("basewall8BoundingBoxPlaneOrigin;basewall8BoundingBoxPlaneAxisvectorsZ;basewall8BoundingBox(DimX1,DimX2)basewall8BoundingBox(DimY1,DimY2);basewall8BoundingBoxDimV;basewall8BoundingBoxBottomPoint1;basewall8BoundingBoxBottomPoint2;basewall8BoundingBoxBottomPoint3;basewall8BoundingBoxBottomPoint4;basewall8BoundingBoxvectordirection")
dedomain_3 = DeconstructDomain(Domain=debox_2.X)  # -> Start, End; disabled
dedomain_4 = DeconstructDomain(Domain=debox_2.Y)  # -> Start, End; disabled
split_5 = TextSplit(Text=debox_2.Plane, Separators=panel_60)  # disabled
panel_66 = Panel("basewall7BoundingBoxPlaneOrigin;basewall7BoundingBoxPlaneAxisvectorsZ;basewall7BoundingBox(DimX1,DimX2)basewall7BoundingBox(DimY1,DimY2);basewall7BoundingBoxDimV;basewall7BoundingBoxBottomPoint1;basewall7BoundingBoxBottomPoint2;basewall7BoundingBoxBottomPoint3;basewall7BoundingBoxBottomPoint4;basewall7BoundingBoxvectordirection")
area_9 = Area(Geometry=bbox_7.Box)  # -> Area, Centroid; disabled
bbox_10 = BoundingBox(Content=divide_13.Points, Plane=plfit_10.Plane, UnionBox=True)  # -> Box, Box_2; disabled
area_10 = Area(Geometry=bbox_10.Box)  # -> Area, Centroid; disabled
box_corners_4 = BoxCorners(Box=bbox_4.Box)  # -> CornerA, CornerB, CornerC, CornerD, CornerE, CornerF, CornerG, CornerH; disabled
panel_67 = Panel("basewall10BoundingBoxPlaneOrigin;basewall10BoundingBoxPlaneAxisvectorsZ;basewall10BoundingBox(DimX1,DimX2)basewall10BoundingBox(DimY1,DimY2);basewall10BoundingBoxDimV;basewall10BoundingBoxBottomPoint1;basewall10BoundingBoxBottomPoint2;basewall10BoundingBoxBottomPoint3;basewall10BoundingBoxBottomPoint4;basewall10BoundingBoxvectordirection")
area_11 = Area(Geometry=bbox_8.Box)  # -> Area, Centroid; disabled
debox_4 = DeconstructBox(Box=bbox_4.Box)  # -> Plane, X, Y, Z; disabled
panel_68 = Panel(" ")  # disabled
panel_69 = Panel("basewall9BoundingBoxPlaneOrigin;basewall9BoundingBoxPlaneAxisvectorsZ;basewall9BoundingBox(DimX1,DimX2)basewall9BoundingBox(DimY1,DimY2);basewall9BoundingBoxDimV;basewall9BoundingBoxBottomPoint1;basewall9BoundingBoxBottomPoint2;basewall9BoundingBoxBottomPoint3;basewall9BoundingBoxBottomPoint4;basewall9BoundingBoxvectordirection")
vec2pt_4 = Vector2Pt(PointA=midpt, PointB=area_5.Centroid, Unitize=False)  # -> Vector, Length; disabled
vec2pt_5 = Vector2Pt(PointA=midpt, PointB=area_7.Centroid, Unitize=False)  # -> Vector, Length; disabled
box_corners_5 = BoxCorners(Box=bbox_5.Box)  # -> CornerA, CornerB, CornerC, CornerD, CornerE, CornerF, CornerG, CornerH; disabled
dedomain_5 = DeconstructDomain(Domain=debox_3.X)  # -> Start, End; disabled
dedomain_6 = DeconstructDomain(Domain=debox_3.Y)  # -> Start, End; disabled
panel_70 = Panel(";")  # disabled
split_6 = TextSplit(Text=debox_3.Plane, Separators=panel_63)  # disabled
debox_5 = DeconstructBox(Box=bbox_5.Box)  # -> Plane, X, Y, Z; disabled
vec2pt_6 = Vector2Pt(PointA=midpt, PointB=area_10.Centroid, Unitize=False)  # -> Vector, Length; disabled
box_corners_6 = BoxCorners(Box=bbox_6.Box)  # -> CornerA, CornerB, CornerC, CornerD, CornerE, CornerF, CornerG, CornerH; disabled
panel_71 = Panel(" ")  # disabled
panel_72 = Panel(";")  # disabled
debox_6 = DeconstructBox(Box=bbox_6.Box)  # -> Plane, X, Y, Z; disabled
vec2pt_7 = Vector2Pt(PointA=midpt, PointB=area_6.Centroid, Unitize=False)  # -> Vector, Length; disabled
item_4 = ListItem(List=split_4, Index=0, Wrap=True)  # disabled
item_5 = ListItem(List=split_4, Index=1, Wrap=True)  # disabled
box_corners_7 = BoxCorners(Box=bbox_7.Box)  # -> CornerA, CornerB, CornerC, CornerD, CornerE, CornerF, CornerG, CornerH; disabled
panel_73 = Panel(" ")  # disabled
box_corners_8 = BoxCorners(Box=bbox_8.Box)  # -> CornerA, CornerB, CornerC, CornerD, CornerE, CornerF, CornerG, CornerH; disabled
debox_7 = DeconstructBox(Box=bbox_7.Box)  # -> Plane, X, Y, Z; disabled
vec2pt_8 = Vector2Pt(PointA=midpt, PointB=area_8.Centroid, Unitize=False)  # -> Vector, Length; disabled
box_corners_9 = BoxCorners(Box=bbox_9.Box)  # -> CornerA, CornerB, CornerC, CornerD, CornerE, CornerF, CornerG, CornerH; disabled
item_6 = ListItem(List=split_5, Index=0, Wrap=True)  # disabled
item_7 = ListItem(List=split_5, Index=1, Wrap=True)  # disabled
debox_8 = DeconstructBox(Box=bbox_8.Box)  # -> Plane, X, Y, Z; disabled
panel_74 = Panel(" ")  # disabled
debox_9 = DeconstructBox(Box=bbox_9.Box)  # -> Plane, X, Y, Z; disabled
vec2pt_9 = Vector2Pt(PointA=midpt, PointB=area_9.Centroid, Unitize=False)  # -> Vector, Length; disabled
divide_15 = DivideCurve(Curve=bang_2.Branch0, Count=30, Kinks=False)  # -> simplify(flatten(Points)), Tangents, Parameters
dedomain_7 = DeconstructDomain(Domain=debox_4.X)  # -> Start, End; disabled
dedomain_8 = DeconstructDomain(Domain=debox_4.Y)  # -> Start, End; disabled
panel_75 = Panel(" ")  # disabled
divide_16 = DivideCurve(Curve=bang_2.Branch1, Count=30, Kinks=False)  # -> simplify(flatten(Points)), Tangents, Parameters
split_7 = TextSplit(Text=debox_4.Plane, Separators=panel_68)  # disabled
divide_17 = DivideCurve(Curve=bang_2.Branch2, Count=30, Kinks=False)  # -> simplify(flatten(Points)), Tangents, Parameters
divide_18 = DivideCurve(Curve=bang_2.Branch3, Count=30, Kinks=False)  # -> simplify(flatten(Points)), Tangents, Parameters
box_corners_10 = BoxCorners(Box=bbox_10.Box)  # -> CornerA, CornerB, CornerC, CornerD, CornerE, CornerF, CornerG, CornerH; disabled
divide_19 = DivideCurve(Curve=bang_2.Branch5, Count=30, Kinks=False)  # -> simplify(flatten(Points)), Tangents, Parameters
panel_76 = Panel(";")  # disabled
vec2pt_10 = Vector2Pt(PointA=midpt, PointB=area_11.Centroid, Unitize=False)  # -> Vector, Length; disabled
divide_20 = DivideCurve(Curve=bang_2.Branch4, Count=30, Kinks=False)  # -> simplify(flatten(Points)), Tangents, Parameters
panel_77 = Panel(" ")  # disabled
divide_21 = DivideCurve(Curve=bang_2.Branch6, Count=30, Kinks=False)  # -> simplify(flatten(Points)), Tangents, Parameters
debox_10 = DeconstructBox(Box=bbox_10.Box)  # -> Plane, X, Y, Z; disabled
divide_22 = DivideCurve(Curve=bang_2.Branch7, Count=30, Kinks=False)  # -> simplify(flatten(Points)), Tangents, Parameters
panel_78 = Panel(" ")  # disabled
divide_23 = DivideCurve(Curve=bang_2.Branch8, Count=30, Kinks=False)  # -> simplify(flatten(Points)), Tangents, Parameters
divide_24 = DivideCurve(Curve=bang_2.Branch9, Count=30, Kinks=False)  # -> simplify(flatten(Points)), Tangents, Parameters
item_8 = ListItem(List=split_6, Index=0, Wrap=True)  # disabled
dedomain_9 = DeconstructDomain(Domain=debox_5.X)  # -> Start, End; disabled
dedomain_10 = DeconstructDomain(Domain=debox_5.Y)  # -> Start, End; disabled
item_9 = ListItem(List=split_6, Index=1, Wrap=True)  # disabled
split_8 = TextSplit(Text=debox_5.Plane, Separators=panel_71)  # disabled
dedomain_11 = DeconstructDomain(Domain=debox_6.X)  # -> Start, End; disabled
dedomain_12 = DeconstructDomain(Domain=debox_6.Y)  # -> Start, End; disabled
split_9 = TextSplit(Text=debox_6.Plane, Separators=panel_73)  # disabled
dedomain_13 = DeconstructDomain(Domain=debox_7.X)  # -> Start, End; disabled
dedomain_14 = DeconstructDomain(Domain=debox_7.Y)  # -> Start, End; disabled
split_10 = TextSplit(Text=debox_7.Plane, Separators=panel_74)  # disabled
panel_79 = Panel(";")  # disabled
dedomain_15 = DeconstructDomain(Domain=debox_8.X)  # -> Start, End; disabled
dedomain_16 = DeconstructDomain(Domain=debox_8.Y)  # -> Start, End; disabled
split_11 = TextSplit(Text=debox_8.Plane, Separators=panel_75)  # disabled
plfit_11 = PlaneFit(Points=divide_15.Points)  # -> Plane, Deviation
dedomain_17 = DeconstructDomain(Domain=debox_9.X)  # -> Start, End; disabled
dedomain_18 = DeconstructDomain(Domain=debox_9.Y)  # -> Start, End; disabled
concat_4 = Concatenate(
    FragmentV=item_4,
    FragmentU=panel_70,
    FragmentT=item_5,
    FragmentS=panel_70,
    FragmentR=dedomain.Start,
    FragmentQ=panel_70,
    FragmentP=dedomain.End,
    FragmentO=panel_70,
    FragmentN=dedomain_2.Start,
    FragmentA=panel_70,
    FragmentB=panel_70,
    FragmentC=dedomain_2.End,
    FragmentD=panel_70,
    FragmentE=box_corners.CornerA,
    FragmentF=panel_70,
    FragmentH=box_corners.CornerB,
    FragmentG=panel_70,
    FragmentI=box_corners.CornerC,
    FragmentJ=panel_70,
    FragmentK=box_corners.CornerD,
    FragmentL=panel_70,
    FragmentM=vec2pt.Vector)  # -> flatten(Result); disabled
split_12 = TextSplit(Text=debox_9.Plane, Separators=panel_77)  # disabled
item_10 = ListItem(List=split_7, Index=0, Wrap=True)  # disabled
item_11 = ListItem(List=split_7, Index=1, Wrap=True)  # disabled
plfit_12 = PlaneFit(Points=divide_16.Points)  # -> Plane, Deviation
dedomain_19 = DeconstructDomain(Domain=debox_10.X)  # -> Start, End; disabled
dedomain_20 = DeconstructDomain(Domain=debox_10.Y)  # -> Start, End; disabled
panel_80 = Panel(";")  # disabled
concat_5 = Concatenate(
    FragmentV=item_6,
    FragmentU=panel_72,
    FragmentT=item_7,
    FragmentS=panel_72,
    FragmentR=dedomain_3.Start,
    FragmentQ=panel_72,
    FragmentP=dedomain_3.End,
    FragmentO=panel_72,
    FragmentN=dedomain_4.Start,
    FragmentA=panel_72,
    FragmentB=panel_72,
    FragmentC=dedomain_4.End,
    FragmentD=panel_72,
    FragmentE=box_corners_2.CornerA,
    FragmentF=panel_72,
    FragmentH=box_corners_2.CornerB,
    FragmentG=panel_72,
    FragmentI=box_corners_2.CornerC,
    FragmentJ=panel_72,
    FragmentK=box_corners_2.CornerD,
    FragmentL=panel_72,
    FragmentM=vec2pt_2.Vector)  # -> flatten(Result); disabled
split_13 = TextSplit(Text=debox_10.Plane, Separators=panel_78)  # disabled
panel_81 = Panel(";")  # disabled
item_12 = ListItem(List=split_8, Index=0, Wrap=True)  # disabled
item_13 = ListItem(List=split_8, Index=1, Wrap=True)  # disabled
panel_82 = Panel(";")  # disabled
item_14 = ListItem(List=split_9, Index=0, Wrap=True)  # disabled
plfit_13 = PlaneFit(Points=divide_17.Points)  # -> Plane, Deviation
item_15 = ListItem(List=split_9, Index=1, Wrap=True)  # disabled
panel_83 = Panel(";")  # disabled
concat_6 = Concatenate(
    FragmentV=item_8,
    FragmentU=panel_76,
    FragmentT=item_9,
    FragmentS=panel_76,
    FragmentR=dedomain_5.Start,
    FragmentQ=panel_76,
    FragmentP=dedomain_5.End,
    FragmentO=panel_76,
    FragmentN=dedomain_6.Start,
    FragmentA=panel_76,
    FragmentB=panel_76,
    FragmentC=dedomain_6.End,
    FragmentD=panel_76,
    FragmentE=box_corners_3.CornerA,
    FragmentF=panel_76,
    FragmentH=box_corners_3.CornerB,
    FragmentG=panel_76,
    FragmentI=box_corners_3.CornerC,
    FragmentJ=panel_76,
    FragmentK=box_corners_3.CornerD,
    FragmentL=panel_76,
    FragmentM=vec2pt_3.Vector)  # -> flatten(Result); disabled
intcrv_7 = Interpolate(Vertices=divide_15.Points, Degree=3, Periodic=False, KnotStyle=1)  # -> Curve, Length, Domain
panel_84 = Panel(";")  # disabled
item_16 = ListItem(List=split_10, Index=0, Wrap=True)  # disabled
item_17 = ListItem(List=split_10, Index=1, Wrap=True)  # disabled
item_18 = ListItem(List=split_11, Index=0, Wrap=True)  # disabled
item_19 = ListItem(List=split_11, Index=1, Wrap=True)  # disabled
panel_85 = Panel(";")  # disabled
item_20 = ListItem(List=split_12, Index=0, Wrap=True)  # disabled
item_21 = ListItem(List=split_12, Index=1, Wrap=True)  # disabled
item_22 = ListItem(List=split_13, Index=0, Wrap=True)  # disabled
bbox_11 = BoundingBox(Content=divide_15.Points, Plane=plfit_11.Plane, UnionBox=True)  # -> Box, Box_2
item_23 = ListItem(List=split_13, Index=1, Wrap=True)  # disabled
plfit_14 = PlaneFit(Points=divide_18.Points)  # -> Plane, Deviation
concat_7 = Concatenate(
    FragmentV=item_10,
    FragmentU=panel_79,
    FragmentT=item_11,
    FragmentS=panel_79,
    FragmentR=dedomain_7.Start,
    FragmentQ=panel_79,
    FragmentP=dedomain_7.End,
    FragmentO=panel_79,
    FragmentN=dedomain_8.Start,
    FragmentA=panel_79,
    FragmentB=panel_79,
    FragmentC=dedomain_8.End,
    FragmentD=panel_79,
    FragmentE=box_corners_4.CornerA,
    FragmentF=panel_79,
    FragmentH=box_corners_4.CornerB,
    FragmentG=panel_79,
    FragmentI=box_corners_4.CornerC,
    FragmentJ=panel_79,
    FragmentK=box_corners_4.CornerD,
    FragmentL=panel_79,
    FragmentM=vec2pt_4.Vector)  # -> flatten(Result); disabled
bbox_12 = BoundingBox(Content=divide_16.Points, Plane=plfit_12.Plane, UnionBox=True)  # -> Box, Box_2
merge_4 = Merge(Data1=panel_35, Data2=concat_4)  # disabled
area_12 = Area(Geometry=bbox_11.Box)  # -> Area, Centroid
plfit_15 = PlaneFit(Points=divide_20.Points)  # -> Plane, Deviation
concat_8 = Concatenate(
    FragmentV=item_12,
    FragmentU=panel_80,
    FragmentT=item_13,
    FragmentS=panel_80,
    FragmentR=dedomain_9.Start,
    FragmentQ=panel_80,
    FragmentP=dedomain_9.End,
    FragmentO=panel_80,
    FragmentN=dedomain_10.Start,
    FragmentA=panel_80,
    FragmentB=panel_80,
    FragmentC=dedomain_10.End,
    FragmentD=panel_80,
    FragmentE=box_corners_5.CornerA,
    FragmentF=panel_80,
    FragmentH=box_corners_5.CornerB,
    FragmentG=panel_80,
    FragmentI=box_corners_5.CornerC,
    FragmentJ=panel_80,
    FragmentK=box_corners_5.CornerD,
    FragmentL=panel_80,
    FragmentM=vec2pt_7.Vector)  # -> flatten(Result); disabled
merge_5 = Merge(Data1=panel_36, Data2=concat_5)  # disabled
area_13 = Area(Geometry=bbox_12.Box)  # -> Area, Centroid
plfit_16 = PlaneFit(Points=divide_19.Points)  # -> Plane, Deviation
concat_9 = Concatenate(
    FragmentV=item_14,
    FragmentU=panel_81,
    FragmentT=item_15,
    FragmentS=panel_81,
    FragmentR=dedomain_11.Start,
    FragmentQ=panel_81,
    FragmentP=dedomain_11.End,
    FragmentO=panel_81,
    FragmentN=dedomain_12.Start,
    FragmentA=panel_81,
    FragmentB=panel_81,
    FragmentC=dedomain_12.End,
    FragmentD=panel_81,
    FragmentE=box_corners_6.CornerA,
    FragmentF=panel_81,
    FragmentH=box_corners_6.CornerB,
    FragmentG=panel_81,
    FragmentI=box_corners_6.CornerC,
    FragmentJ=panel_81,
    FragmentK=box_corners_6.CornerD,
    FragmentL=panel_81,
    FragmentM=vec2pt_8.Vector)  # -> flatten(Result); disabled
bbox_13 = BoundingBox(Content=divide_17.Points, Plane=plfit_13.Plane, UnionBox=True)  # -> Box, Box_2
plfit_17 = PlaneFit(Points=divide_22.Points)  # -> Plane, Deviation
concat_10 = Concatenate(
    FragmentV=item_16,
    FragmentU=panel_82,
    FragmentT=item_17,
    FragmentS=panel_82,
    FragmentR=dedomain_13.Start,
    FragmentQ=panel_82,
    FragmentP=dedomain_13.End,
    FragmentO=panel_82,
    FragmentN=dedomain_14.Start,
    FragmentA=panel_82,
    FragmentB=panel_82,
    FragmentC=dedomain_14.End,
    FragmentD=panel_82,
    FragmentE=box_corners_7.CornerA,
    FragmentF=panel_82,
    FragmentH=box_corners_7.CornerB,
    FragmentG=panel_82,
    FragmentI=box_corners_7.CornerC,
    FragmentJ=panel_82,
    FragmentK=box_corners_7.CornerD,
    FragmentL=panel_82,
    FragmentM=vec2pt_9.Vector)  # -> flatten(Result); disabled
plfit_18 = PlaneFit(Points=divide_21.Points)  # -> Plane, Deviation
concat_11 = Concatenate(
    FragmentV=item_18,
    FragmentU=panel_83,
    FragmentT=item_19,
    FragmentS=panel_83,
    FragmentR=dedomain_15.Start,
    FragmentQ=panel_83,
    FragmentP=dedomain_15.End,
    FragmentO=panel_83,
    FragmentN=dedomain_16.Start,
    FragmentA=panel_83,
    FragmentB=panel_83,
    FragmentC=dedomain_16.End,
    FragmentD=panel_83,
    FragmentE=box_corners_8.CornerA,
    FragmentF=panel_83,
    FragmentH=box_corners_8.CornerB,
    FragmentG=panel_83,
    FragmentI=box_corners_8.CornerC,
    FragmentJ=panel_83,
    FragmentK=box_corners_8.CornerD,
    FragmentL=panel_83,
    FragmentM=vec2pt_10.Vector)  # -> flatten(Result); disabled
plfit_19 = PlaneFit(Points=divide_24.Points)  # -> Plane, Deviation
concat_12 = Concatenate(
    FragmentV=item_20,
    FragmentU=panel_84,
    FragmentT=item_21,
    FragmentS=panel_84,
    FragmentR=dedomain_17.Start,
    FragmentQ=panel_84,
    FragmentP=dedomain_17.End,
    FragmentO=panel_84,
    FragmentN=dedomain_18.Start,
    FragmentA=panel_84,
    FragmentB=panel_84,
    FragmentC=dedomain_18.End,
    FragmentD=panel_84,
    FragmentE=box_corners_9.CornerA,
    FragmentF=panel_84,
    FragmentH=box_corners_9.CornerB,
    FragmentG=panel_84,
    FragmentI=box_corners_9.CornerC,
    FragmentJ=panel_84,
    FragmentK=box_corners_9.CornerD,
    FragmentL=panel_84,
    FragmentM=vec2pt_5.Vector)  # -> flatten(Result); disabled
merge_6 = Merge(Data1=panel_38, Data2=concat_6)  # disabled
area_14 = Area(Geometry=bbox_13.Box)  # -> Area, Centroid
box_corners_11 = BoxCorners(Box=bbox_11.Box)  # -> CornerA, CornerB, CornerC, CornerD, CornerE, CornerF, CornerG, CornerH
plfit_20 = PlaneFit(Points=divide_23.Points)  # -> Plane, Deviation
debox_11 = DeconstructBox(Box=bbox_11.Box)  # -> Plane, X, Y, Z
concat_13 = Concatenate(
    FragmentV=item_22,
    FragmentU=panel_85,
    FragmentT=item_23,
    FragmentS=panel_85,
    FragmentR=dedomain_19.Start,
    FragmentQ=panel_85,
    FragmentP=dedomain_19.End,
    FragmentO=panel_85,
    FragmentN=dedomain_20.Start,
    FragmentA=panel_85,
    FragmentB=panel_85,
    FragmentC=dedomain_20.End,
    FragmentD=panel_85,
    FragmentE=box_corners_10.CornerA,
    FragmentF=panel_85,
    FragmentH=box_corners_10.CornerB,
    FragmentG=panel_85,
    FragmentI=box_corners_10.CornerC,
    FragmentJ=panel_85,
    FragmentK=box_corners_10.CornerD,
    FragmentL=panel_85,
    FragmentM=vec2pt_6.Vector)  # -> flatten(Result); disabled
box_corners_12 = BoxCorners(Box=bbox_12.Box)  # -> CornerA, CornerB, CornerC, CornerD, CornerE, CornerF, CornerG, CornerH
bbox_14 = BoundingBox(Content=divide_18.Points, Plane=plfit_14.Plane, UnionBox=True)  # -> Box, Box_2
vec2pt_11 = Vector2Pt(PointA=midpt_2, PointB=area_12.Centroid, Unitize=False)  # -> Vector, Length
debox_12 = DeconstructBox(Box=bbox_12.Box)  # -> Plane, X, Y, Z
vec2pt_12 = Vector2Pt(PointA=midpt_2, PointB=area_13.Centroid, Unitize=False)  # -> Vector, Length
bbox_15 = BoundingBox(Content=divide_20.Points, Plane=plfit_15.Plane, UnionBox=True)  # -> Box, Box_2
merge_7 = Merge(Data1=panel_39, Data2=concat_7)  # disabled
area_15 = Area(Geometry=bbox_14.Box)  # -> Area, Centroid
box_corners_13 = BoxCorners(Box=bbox_13.Box)  # -> CornerA, CornerB, CornerC, CornerD, CornerE, CornerF, CornerG, CornerH
bbox_16 = BoundingBox(Content=divide_19.Points, Plane=plfit_16.Plane, UnionBox=True)  # -> Box, Box_2
debox_13 = DeconstructBox(Box=bbox_13.Box)  # -> Plane, X, Y, Z
bbox_17 = BoundingBox(Content=divide_22.Points, Plane=plfit_17.Plane, UnionBox=True)  # -> Box, Box_2
merge_8 = Merge(Data1=panel_40, Data2=concat_8)  # disabled
area_16 = Area(Geometry=bbox_15.Box)  # -> Area, Centroid
vec2pt_13 = Vector2Pt(PointA=midpt_2, PointB=area_14.Centroid, Unitize=False)  # -> Vector, Length
dedomain_21 = DeconstructDomain(Domain=debox_11.X)  # -> Start, End
dedomain_22 = DeconstructDomain(Domain=debox_11.Y)  # -> Start, End
bbox_18 = BoundingBox(Content=divide_21.Points, Plane=plfit_18.Plane, UnionBox=True)  # -> Box, Box_2
split_14 = TextSplit(Text=debox_11.Plane, Separators=" ")
bbox_19 = BoundingBox(Content=divide_24.Points, Plane=plfit_19.Plane, UnionBox=True)  # -> Box, Box_2
area_17 = Area(Geometry=bbox_19.Box)  # -> Area, Centroid
merge_9 = Merge(Data1=panel_41, Data2=concat_9)  # disabled
area_18 = Area(Geometry=bbox_16.Box)  # -> Area, Centroid
dedomain_23 = DeconstructDomain(Domain=debox_12.X)  # -> Start, End
dedomain_24 = DeconstructDomain(Domain=debox_12.Y)  # -> Start, End
split_15 = TextSplit(Text=debox_12.Plane, Separators=" ")
merge_10 = Merge(Data1=panel_42, Data2=concat_10)  # disabled
area_19 = Area(Geometry=bbox_17.Box)  # -> Area, Centroid
bbox_20 = BoundingBox(Content=divide_23.Points, Plane=plfit_20.Plane, UnionBox=True)  # -> Box, Box_2
area_20 = Area(Geometry=bbox_20.Box)  # -> Area, Centroid
box_corners_14 = BoxCorners(Box=bbox_14.Box)  # -> CornerA, CornerB, CornerC, CornerD, CornerE, CornerF, CornerG, CornerH
merge_11 = Merge(Data1=panel_43, Data2=concat_11)  # disabled
area_21 = Area(Geometry=bbox_18.Box)  # -> Area, Centroid
debox_14 = DeconstructBox(Box=bbox_14.Box)  # -> Plane, X, Y, Z
merge_12 = Merge(Data1=panel_44, Data2=concat_12)  # disabled
vec2pt_14 = Vector2Pt(PointA=midpt_2, PointB=area_15.Centroid, Unitize=False)  # -> Vector, Length
vec2pt_15 = Vector2Pt(PointA=midpt_2, PointB=area_17.Centroid, Unitize=False)  # -> Vector, Length
box_corners_15 = BoxCorners(Box=bbox_15.Box)  # -> CornerA, CornerB, CornerC, CornerD, CornerE, CornerF, CornerG, CornerH
merge_13 = Merge(Data1=panel_45, Data2=concat_13)  # disabled
dedomain_25 = DeconstructDomain(Domain=debox_13.X)  # -> Start, End
dedomain_26 = DeconstructDomain(Domain=debox_13.Y)  # -> Start, End
split_16 = TextSplit(Text=debox_13.Plane, Separators=" ")
debox_15 = DeconstructBox(Box=bbox_15.Box)  # -> Plane, X, Y, Z
vec2pt_16 = Vector2Pt(PointA=midpt_2, PointB=area_20.Centroid, Unitize=False)  # -> Vector, Length
box_corners_16 = BoxCorners(Box=bbox_16.Box)  # -> CornerA, CornerB, CornerC, CornerD, CornerE, CornerF, CornerG, CornerH
debox_16 = DeconstructBox(Box=bbox_16.Box)  # -> Plane, X, Y, Z
vec2pt_17 = Vector2Pt(PointA=midpt_2, PointB=area_16.Centroid, Unitize=False)  # -> Vector, Length
item_24 = ListItem(List=split_14, Index=0, Wrap=True)
item_25 = ListItem(List=split_14, Index=1, Wrap=True)
box_corners_17 = BoxCorners(Box=bbox_17.Box)  # -> CornerA, CornerB, CornerC, CornerD, CornerE, CornerF, CornerG, CornerH
box_corners_18 = BoxCorners(Box=bbox_18.Box)  # -> CornerA, CornerB, CornerC, CornerD, CornerE, CornerF, CornerG, CornerH
debox_17 = DeconstructBox(Box=bbox_17.Box)  # -> Plane, X, Y, Z
vec2pt_18 = Vector2Pt(PointA=midpt_2, PointB=area_18.Centroid, Unitize=False)  # -> Vector, Length
box_corners_19 = BoxCorners(Box=bbox_19.Box)  # -> CornerA, CornerB, CornerC, CornerD, CornerE, CornerF, CornerG, CornerH
item_26 = ListItem(List=split_15, Index=0, Wrap=True)
item_27 = ListItem(List=split_15, Index=1, Wrap=True)
debox_18 = DeconstructBox(Box=bbox_18.Box)  # -> Plane, X, Y, Z
debox_19 = DeconstructBox(Box=bbox_19.Box)  # -> Plane, X, Y, Z
vec2pt_19 = Vector2Pt(PointA=midpt_2, PointB=area_19.Centroid, Unitize=False)  # -> Vector, Length
dedomain_27 = DeconstructDomain(Domain=debox_14.X)  # -> Start, End
dedomain_28 = DeconstructDomain(Domain=debox_14.Y)  # -> Start, End
split_17 = TextSplit(Text=debox_14.Plane, Separators=" ")
box_corners_20 = BoxCorners(Box=bbox_20.Box)  # -> CornerA, CornerB, CornerC, CornerD, CornerE, CornerF, CornerG, CornerH
vec2pt_20 = Vector2Pt(PointA=midpt_2, PointB=area_21.Centroid, Unitize=False)  # -> Vector, Length
debox_20 = DeconstructBox(Box=bbox_20.Box)  # -> Plane, X, Y, Z
item_28 = ListItem(List=split_16, Index=0, Wrap=True)
dedomain_29 = DeconstructDomain(Domain=debox_15.X)  # -> Start, End
dedomain_30 = DeconstructDomain(Domain=debox_15.Y)  # -> Start, End
item_29 = ListItem(List=split_16, Index=1, Wrap=True)
split_18 = TextSplit(Text=debox_15.Plane, Separators=" ")
dedomain_31 = DeconstructDomain(Domain=debox_16.X)  # -> Start, End
dedomain_32 = DeconstructDomain(Domain=debox_16.Y)  # -> Start, End
split_19 = TextSplit(Text=debox_16.Plane, Separators=" ")
dedomain_33 = DeconstructDomain(Domain=debox_17.X)  # -> Start, End
dedomain_34 = DeconstructDomain(Domain=debox_17.Y)  # -> Start, End
split_20 = TextSplit(Text=debox_17.Plane, Separators=" ")
dedomain_35 = DeconstructDomain(Domain=debox_18.X)  # -> Start, End
dedomain_36 = DeconstructDomain(Domain=debox_18.Y)  # -> Start, End
split_21 = TextSplit(Text=debox_18.Plane, Separators=" ")
dedomain_37 = DeconstructDomain(Domain=debox_19.X)  # -> Start, End
dedomain_38 = DeconstructDomain(Domain=debox_19.Y)  # -> Start, End
concat_14 = Concatenate(
    FragmentV=item_24,
    FragmentU=";",
    FragmentT=item_25,
    FragmentS=";",
    FragmentR=dedomain_21.Start,
    FragmentQ=";",
    FragmentP=dedomain_21.End,
    FragmentO=";",
    FragmentN=dedomain_22.Start,
    FragmentA=";",
    FragmentB=";",
    FragmentC=dedomain_22.End,
    FragmentD=";",
    FragmentE=box_corners_11.CornerA,
    FragmentF=";",
    FragmentH=box_corners_11.CornerB,
    FragmentG=";",
    FragmentI=box_corners_11.CornerC,
    FragmentJ=";",
    FragmentK=box_corners_11.CornerD,
    FragmentL=";",
    FragmentM=vec2pt_11.Vector)  # -> flatten(Result)
split_22 = TextSplit(Text=debox_19.Plane, Separators=" ")
item_30 = ListItem(List=split_17, Index=0, Wrap=True)
item_31 = ListItem(List=split_17, Index=1, Wrap=True)
dedomain_39 = DeconstructDomain(Domain=debox_20.X)  # -> Start, End
dedomain_40 = DeconstructDomain(Domain=debox_20.Y)  # -> Start, End
concat_15 = Concatenate(
    FragmentV=item_26,
    FragmentU=";",
    FragmentT=item_27,
    FragmentS=";",
    FragmentR=dedomain_23.Start,
    FragmentQ=";",
    FragmentP=dedomain_23.End,
    FragmentO=";",
    FragmentN=dedomain_24.Start,
    FragmentA=";",
    FragmentB=";",
    FragmentC=dedomain_24.End,
    FragmentD=";",
    FragmentE=box_corners_12.CornerA,
    FragmentF=";",
    FragmentH=box_corners_12.CornerB,
    FragmentG=";",
    FragmentI=box_corners_12.CornerC,
    FragmentJ=";",
    FragmentK=box_corners_12.CornerD,
    FragmentL=";",
    FragmentM=vec2pt_12.Vector)  # -> flatten(Result)
split_23 = TextSplit(Text=debox_20.Plane, Separators=" ")
item_32 = ListItem(List=split_18, Index=0, Wrap=True)
item_33 = ListItem(List=split_18, Index=1, Wrap=True)
item_34 = ListItem(List=split_19, Index=0, Wrap=True)
item_35 = ListItem(List=split_19, Index=1, Wrap=True)
concat_16 = Concatenate(
    FragmentV=item_28,
    FragmentU=";",
    FragmentT=item_29,
    FragmentS=";",
    FragmentR=dedomain_25.Start,
    FragmentQ=";",
    FragmentP=dedomain_25.End,
    FragmentO=";",
    FragmentN=dedomain_26.Start,
    FragmentA=";",
    FragmentB=";",
    FragmentC=dedomain_26.End,
    FragmentD=";",
    FragmentE=box_corners_13.CornerA,
    FragmentF=";",
    FragmentH=box_corners_13.CornerB,
    FragmentG=";",
    FragmentI=box_corners_13.CornerC,
    FragmentJ=";",
    FragmentK=box_corners_13.CornerD,
    FragmentL=";",
    FragmentM=vec2pt_13.Vector)  # -> flatten(Result)
item_36 = ListItem(List=split_20, Index=0, Wrap=True)
item_37 = ListItem(List=split_20, Index=1, Wrap=True)
item_38 = ListItem(List=split_21, Index=0, Wrap=True)
item_39 = ListItem(List=split_21, Index=1, Wrap=True)
item_40 = ListItem(List=split_22, Index=0, Wrap=True)
item_41 = ListItem(List=split_22, Index=1, Wrap=True)
item_42 = ListItem(List=split_23, Index=0, Wrap=True)
item_43 = ListItem(List=split_23, Index=1, Wrap=True)
concat_17 = Concatenate(
    FragmentV=item_30,
    FragmentU=";",
    FragmentT=item_31,
    FragmentS=";",
    FragmentR=dedomain_27.Start,
    FragmentQ=";",
    FragmentP=dedomain_27.End,
    FragmentO=";",
    FragmentN=dedomain_28.Start,
    FragmentA=";",
    FragmentB=";",
    FragmentC=dedomain_28.End,
    FragmentD=";",
    FragmentE=box_corners_14.CornerA,
    FragmentF=";",
    FragmentH=box_corners_14.CornerB,
    FragmentG=";",
    FragmentI=box_corners_14.CornerC,
    FragmentJ=";",
    FragmentK=box_corners_14.CornerD,
    FragmentL=";",
    FragmentM=vec2pt_14.Vector)  # -> flatten(Result)
merge_14 = Merge(Data1=panel_46, Data2=concat_14)
concat_18 = Concatenate(
    FragmentV=item_32,
    FragmentU=";",
    FragmentT=item_33,
    FragmentS=";",
    FragmentR=dedomain_29.Start,
    FragmentQ=";",
    FragmentP=dedomain_29.End,
    FragmentO=";",
    FragmentN=dedomain_30.Start,
    FragmentA=";",
    FragmentB=";",
    FragmentC=dedomain_30.End,
    FragmentD=";",
    FragmentE=box_corners_15.CornerA,
    FragmentF=";",
    FragmentH=box_corners_15.CornerB,
    FragmentG=";",
    FragmentI=box_corners_15.CornerC,
    FragmentJ=";",
    FragmentK=box_corners_15.CornerD,
    FragmentL=";",
    FragmentM=vec2pt_17.Vector)  # -> flatten(Result)
merge_15 = Merge(Data1=panel_47, Data2=concat_15)
concat_19 = Concatenate(
    FragmentV=item_34,
    FragmentU=";",
    FragmentT=item_35,
    FragmentS=";",
    FragmentR=dedomain_31.Start,
    FragmentQ=";",
    FragmentP=dedomain_31.End,
    FragmentO=";",
    FragmentN=dedomain_32.Start,
    FragmentA=";",
    FragmentB=";",
    FragmentC=dedomain_32.End,
    FragmentD=";",
    FragmentE=box_corners_16.CornerA,
    FragmentF=";",
    FragmentH=box_corners_16.CornerB,
    FragmentG=";",
    FragmentI=box_corners_16.CornerC,
    FragmentJ=";",
    FragmentK=box_corners_16.CornerD,
    FragmentL=";",
    FragmentM=vec2pt_18.Vector)  # -> flatten(Result)
concat_20 = Concatenate(
    FragmentV=item_36,
    FragmentU=";",
    FragmentT=item_37,
    FragmentS=";",
    FragmentR=dedomain_33.Start,
    FragmentQ=";",
    FragmentP=dedomain_33.End,
    FragmentO=";",
    FragmentN=dedomain_34.Start,
    FragmentA=";",
    FragmentB=";",
    FragmentC=dedomain_34.End,
    FragmentD=";",
    FragmentE=box_corners_17.CornerA,
    FragmentF=";",
    FragmentH=box_corners_17.CornerB,
    FragmentG=";",
    FragmentI=box_corners_17.CornerC,
    FragmentJ=";",
    FragmentK=box_corners_17.CornerD,
    FragmentL=";",
    FragmentM=vec2pt_19.Vector)  # -> flatten(Result)
concat_21 = Concatenate(
    FragmentV=item_38,
    FragmentU=";",
    FragmentT=item_39,
    FragmentS=";",
    FragmentR=dedomain_35.Start,
    FragmentQ=";",
    FragmentP=dedomain_35.End,
    FragmentO=";",
    FragmentN=dedomain_36.Start,
    FragmentA=";",
    FragmentB=";",
    FragmentC=dedomain_36.End,
    FragmentD=";",
    FragmentE=box_corners_18.CornerA,
    FragmentF=";",
    FragmentH=box_corners_18.CornerB,
    FragmentG=";",
    FragmentI=box_corners_18.CornerC,
    FragmentJ=";",
    FragmentK=box_corners_18.CornerD,
    FragmentL=";",
    FragmentM=vec2pt_20.Vector)  # -> flatten(Result)
concat_22 = Concatenate(
    FragmentV=item_40,
    FragmentU=";",
    FragmentT=item_41,
    FragmentS=";",
    FragmentR=dedomain_37.Start,
    FragmentQ=";",
    FragmentP=dedomain_37.End,
    FragmentO=";",
    FragmentN=dedomain_38.Start,
    FragmentA=";",
    FragmentB=";",
    FragmentC=dedomain_38.End,
    FragmentD=";",
    FragmentE=box_corners_19.CornerA,
    FragmentF=";",
    FragmentH=box_corners_19.CornerB,
    FragmentG=";",
    FragmentI=box_corners_19.CornerC,
    FragmentJ=";",
    FragmentK=box_corners_19.CornerD,
    FragmentL=";",
    FragmentM=vec2pt_15.Vector)  # -> flatten(Result)
merge_16 = Merge(Data1=panel_48, Data2=concat_16)
concat_23 = Concatenate(
    FragmentV=item_42,
    FragmentU=";",
    FragmentT=item_43,
    FragmentS=";",
    FragmentR=dedomain_39.Start,
    FragmentQ=";",
    FragmentP=dedomain_39.End,
    FragmentO=";",
    FragmentN=dedomain_40.Start,
    FragmentA=";",
    FragmentB=";",
    FragmentC=dedomain_40.End,
    FragmentD=";",
    FragmentE=box_corners_20.CornerA,
    FragmentF=";",
    FragmentH=box_corners_20.CornerB,
    FragmentG=";",
    FragmentI=box_corners_20.CornerC,
    FragmentJ=";",
    FragmentK=box_corners_20.CornerD,
    FragmentL=";",
    FragmentM=vec2pt_16.Vector)  # -> flatten(Result)
merge_17 = Merge(Data1=panel_61, Data2=concat_17)
merge_18 = Merge(Data1=panel_62, Data2=concat_18)
merge_19 = Merge(Data1=panel_64, Data2=concat_19)
merge_20 = Merge(Data1=panel_65, Data2=concat_20)
merge_21 = Merge(Data1=panel_66, Data2=concat_21)
merge_22 = Merge(Data1=panel_67, Data2=concat_22)
merge_23 = Merge(Data1=panel_69, Data2=concat_23)
loft = Loft(
    Curves=arrpolar.Geometry,
    Options={Adjust=False, Closed=True, LoftEnds=0, LoftSimp=0, LoftType=0, Rebuild=10, Refit=0.01})  # disabled
mesh = Mesh(loft)  # disabled
demesh = DeconstructMesh(Mesh=mesh)  # -> Vertices, Faces, Colours, Normals; disabled
faceb = FaceBoundaries(Mesh=mesh)  # disabled
dist_3 = Distance(PointA=midpt, PointB=demesh.Vertices)  # disabled
panel_86 = Panel(".001")  # disabled
swatch_5 = ColourSwatch(SwatchColor=RGB(255, 255, 255))  # disabled
crv = Curve(faceb)  # disabled
bnd = Bounds(Numbers=dist_3)  # disabled
intcrv_8 = Interpolate(Vertices=divide_5.Points, Degree=3, Periodic=False, KnotStyle=1)  # -> Curve, Length, Domain; disabled
intcrv_9 = Interpolate(Vertices=divide_6.Points, Degree=3, Periodic=False, KnotStyle=1)  # -> Curve, Length, Domain; disabled
dedomain_41 = DeconstructDomain(Domain=bnd)  # -> Start, End; disabled
previewlw_6 = CustomPreviewLineweights(Geometry=crv, Shader=swatch_5, Thickness=panel_86, Absolute=True)  # disabled
gradient = Gradient(
    LowerLimit=dedomain_41.Start,
    UpperLimit=dedomain_41.End,
    Parameter=dist_3,
    stops=[0: RGB(243, 57, 0), 0.1: RGB(236, 27, 60), 0.2: RGB(210, 0, 118), 0.3: RGB(103, 0, 120), 0.4: RGB(39, 72, 161), 0.5: RGB(1, 192, 229), 0.6: RGB(18, 178, 90), 0.7: RGB(79, 186, 8), 0.8: RGB(220, 237, 32), 0.9: RGB(247, 159, 20), 1: RGB(243, 57, 0)])  # disabled
loft_2 = Loft(
    Curves=arrpolar_2.Geometry,
    Options={Adjust=False, Closed=True, LoftEnds=0, LoftSimp=0, LoftType=0, Rebuild=10, Refit=0.01})
mesh_2 = Mesh(loft_2)
demesh_2 = DeconstructMesh(Mesh=mesh_2)  # -> Vertices, Faces, Colours, Normals
intcrv_10 = Interpolate(Vertices=divide_16.Points, Degree=3, Periodic=False, KnotStyle=1)  # -> Curve, Length, Domain
intcrv_11 = Interpolate(Vertices=divide_17.Points, Degree=3, Periodic=False, KnotStyle=1)  # -> Curve, Length, Domain
intcrv_12 = Interpolate(Vertices=divide_15.Points, Degree=3, Periodic=False, KnotStyle=1)  # -> Curve, Length, Domain
faceb_2 = FaceBoundaries(Mesh=mesh_2)
dist_4 = Distance(PointA=midpt_2, PointB=demesh_2.Vertices)
crv_2 = Curve(faceb_2)
bnd_2 = Bounds(Numbers=dist_4)
conmesh = ConstructMesh(Vertices=demesh.Vertices, Faces=demesh.Faces, Colours=gradient)  # disabled
dedomain_42 = DeconstructDomain(Domain=bnd_2)  # -> Start, End
previewlw_7 = CustomPreviewLineweights(Geometry=crv_2, Shader=ColourSwatch(SwatchColor=RGB(255, 255, 255)), Thickness=".001", Absolute=True)
midpt_3 = CurveMiddle(Curve=intcrv_12.Curve)
midpt_4 = CurveMiddle(Curve=intcrv_10.Curve)
gradient_2 = Gradient(
    LowerLimit=dedomain_42.Start,
    UpperLimit=dedomain_42.End,
    Parameter=dist_4,
    stops=[0: RGB(243, 57, 0), 0.1: RGB(236, 27, 60), 0.2: RGB(210, 0, 118), 0.3: RGB(103, 0, 120), 0.4: RGB(39, 72, 161), 0.5: RGB(1, 192, 229), 0.6: RGB(18, 178, 90), 0.7: RGB(79, 186, 8), 0.8: RGB(220, 237, 32), 0.9: RGB(247, 159, 20), 1: RGB(243, 57, 0)])
intcrv_13 = Interpolate(Vertices=[midpt_3, midpt_4], Degree=3, Periodic=False, KnotStyle=1)  # -> Curve, Length, Domain
merge_24 = Merge(Data1=divide_5.Points, Data2=pt)  # disabled
conmesh_2 = ConstructMesh(Vertices=demesh_2.Vertices, Faces=demesh_2.Faces, Colours=gradient_2)
merge_25 = Merge(
    Data1=merge_4,
    Data2=merge_5,
    Data3=merge_6,
    Data4=merge_7,
    Data5=merge_8,
    Data6=merge_9,
    Data7=merge_11,
    Data8=merge_10,
    Data9=merge_13,
    Data10=merge_12)  # disabled
railrev = RailRevolution(Curve=intcrv_12.Curve, Rail=intcrv_13.Curve, Axis=ln_2, Scale=False)
merge_26 = Merge(
    Data1=merge_25,
    Data2=panel_54,
    Data3=merge_24,
    Data4=panel_51,
    Data5=divide_6.Points,
    Data6=panel_49,
    Data7=divide_7.Points,
    Data8=panel_52,
    Data9=divide_8.Points,
    Data10=panel_50,
    Data11=divide_10.Points,
    Data12=panel_53,
    Data13=divide_9.Points,
    Data14=panel_57,
    Data15=divide_11.Points,
    Data16=panel_55,
    Data17=divide_12.Points,
    Data18=panel_58,
    Data19=divide_13.Points,
    Data20=panel_59,
    Data21=divide_14.Points)  # -> flatten(Result); disabled
brep = Brep(railrev)
panel_87 = Panel("{")  # disabled
panel_88 = Panel("(")  # disabled
rep_7 = ReplaceText(Text=merge_26, Find=panel_87, Replace=panel_88, RecursiveReplace=False)  # disabled
panel_89 = Panel("}")  # disabled
panel_90 = Panel(")")  # disabled
merge_27 = Merge(Data1=divide_15.Points, Data2=pt)
rep_8 = ReplaceText(Text=rep_7, Find=panel_89, Replace=panel_90, RecursiveReplace=False)  # disabled
merge_28 = Merge(
    Data1=merge_14,
    Data2=merge_15,
    Data3=merge_16,
    Data4=merge_17,
    Data5=merge_18,
    Data6=merge_19,
    Data7=merge_21,
    Data8=merge_20,
    Data9=merge_23,
    Data10=merge_22)
unroll = UnrollBrep(Brep=brep, JoinUnrolled=True)
panel_91 = Panel("config")  # disabled
merge_29 = Merge(
    Data1=merge_28,
    Data2="basewall1points",
    Data3=merge_27,
    Data4="basewall2points",
    Data5=divide_16.Points,
    Data6="basewall3points",
    Data7=divide_17.Points,
    Data8="basewall4points",
    Data9=divide_18.Points,
    Data10="basewall5points",
    Data11=divide_20.Points,
    Data12="basewall6points",
    Data13=divide_19.Points,
    Data14="basewall7points",
    Data15=divide_21.Points,
    Data16="basewall8points",
    Data17=divide_22.Points,
    Data18="basewall9points",
    Data19=divide_23.Points,
    Data20="basewall10points",
    Data21=divide_24.Points)  # -> flatten(Result)
panel_92 = Panel("C:\Users\KarlRoesch\physVLA\wavetheory\wavein")  # disabled
wires = BrepWireframe(Brep=unroll, Density=-1)
unrollpsrf = UnrollPolysurface(Polysurface=brep)  # -> Unrolled, UnrolledPoints, UnrolledCurves
midpt_5 = CurveMiddle(Curve=wires)
toggle_5 = BooleanToggle(False)  # disabled
rep_9 = ReplaceText(Text=merge_29, Find="{", Replace="(", RecursiveReplace=False)
item_44 = ListItem(List=midpt_5, Index=1, Wrap=True)
panel_93 = Panel("\")  # disabled
item_45 = ListItem(List=midpt_5, Index=0, Wrap=True)
panel_94 = Panel(".txt")  # disabled
toggle_6 = BooleanToggle(False)  # disabled
concat_24 = Concatenate(FragmentC=panel_92, FragmentD=panel_93, FragmentA=panel_91, FragmentE=addition, FragmentB=panel_94)  # disabled
ln_3 = Line(StartPoint=item_44, EndPoint=item_45)
text_data_3 = Text(flatten(rep_8))  # disabled
rep_10 = ReplaceText(Text=rep_9, Find="}", Replace=")", RecursiveReplace=False)
X = UnitX(Factor=ln_3)
path_3 = FilePath(concat_24)  # disabled
move_3 = Move(Geometry=wires, Motion=X)  # -> Geometry, Transform
txtwriter_3 = VBScript(filePath=path_3, data=text_data_3, append=toggle_5, activate=button, clearFile=toggle_6)  # -> out, A; inputs data: list; disabled; same code as txtwriter
move_4 = Move(Geometry=move_3.Geometry, Motion=X)  # -> Geometry, Transform
concat_25 = Concatenate(
    FragmentC="C:\Users\KarlRoesch\physVLA\wavetheory\wavein",
    FragmentD="\",
    FragmentA="config",
    FragmentE=addition,
    FragmentB=".txt")
text_data_4 = Text(flatten(rep_10))
path_4 = FilePath(concat_25)
txtwriter_4 = VBScript(filePath=path_4, data=text_data_4, append=Toggle(False), activate=button, clearFile=Toggle(False))  # -> out, A; inputs data: list; same code as txtwriter

# ---- group: Inputs
swap_uv = BooleanToggle(True)
u_divisions = Slider(5, range=0..20)
v_divisions = Slider(9, range=0..20)
explosion_distance = Slider(32, range=0..100)
layout_spacing = Slider(1.5, range=0..10)
input_surface = Surface(<surface referenced from the Rhino model>)

# ---- group: Triangulate Surface
swap_uv_2 = CSharpScript(S=input_surface, b=swap_uv)  # -> out, A; inputs S: Surface, b: Boolean
# ---------- swap_uv_2: C# ----------
    if(b){
      if(S != null){
        A = S.Transpose();

      }



    }
    else A = S;
# ---------- end swap_uv_2 ----------
divide_25 = DivideDomain²(Domain=swap_uv_2.A, UCount="1", VCount=v_divisions)
divide_26 = DivideDomain²(Domain=graft(divide_25), UCount=u_divisions, VCount="1")
subsrf = Isotrim(Surface=swap_uv_2.A, Domain=divide_26)
explode = BrepComponents(Brep=subsrf)  # -> Faces, Edges, Vertices
_0123 = SeparateListOf4(
    Data=explode.Vertices,
    Data_2=explode.Vertices,
    Data_3=_0123.Data,
    List=_0123.Data,
    Index=0,
    Wrap=False,
    List_2=_0123.Data,
    Index_2=_0123.Pan,
    Wrap_2=False,
    List_3=_0123.Data,
    Index_3=_0123.Pan,
    Wrap_3=False,
    List_4=_0123.Data,
    Index_4=_0123.Pan,
    Wrap_4=False,
    Data_4=_0123.Element,
    Data_5=_0123.Element,
    Data_6=_0123.Element,
    Data_7=_0123.Element,
    Data_8=_0123.Data,
    Data_9=_0123.Data,
    Data_10=_0123.Data,
    Data_11=_0123.Data,
    InternalDocument_plugin_version=(1, 0, 7),
    InternalDocument_DocumentHeader_PreviewMeshType=1,
    InternalDocument_DocumentHeader_PreviewNormal=RGBA(150, 0, 0, 100),
    InternalDocument_DocumentHeader_PreviewSelected=RGBA(0, 120, 0, 100),
    InternalDocument_DefinitionProperties_Projection_Zoom=0.8000000119)  # -> Data, Data_2, Data_3, Data_4, Data_5, Data_6, Data_7, Data_8
slider = Slider(10.941, range=0..110)
srf4pt = _4PointSurface(CornerA=_0123.Data_5, CornerB=_0123.Data_6, CornerC=_0123.Data_7)
srf4pt_2 = _4PointSurface(CornerA=_0123.Data_7, CornerB=_0123.Data_8, CornerC=_0123.Data_5)
series = Series(Start=0, Step=slider, Count=v_divisions)
f1 = FlattenOneLevel(
    Data=srf4pt,
    Data_2=srf4pt,
    ParamViewer=f1.Data,
    Branch=f1.ParamViewer,
    List=f1.Indices,
    Shift=expr("-x", f1.Integer),
    Wrap=False,
    Index=f1.List,
    Integer=f1.Integer,
    Data_3=f1.Data,
    Search=f1.ParamViewer,
    Replace=flatten(f1.Branch),
    Data_4=f1.Data,
    Data_5=f1.Data,
    Data_6=f1.Data,
    Integer_2=f1.Pan,
    Data_7=f1.Data,
    Integer_3=f1.Pan,
    Data_8=f1.Data,
    Data_9=f1.Data,
    InternalDocument_plugin_version=(1, 0, 7),
    InternalDocument_DocumentHeader_PreviewMeshType=1,
    InternalDocument_DocumentHeader_PreviewNormal=RGBA(150, 0, 0, 100),
    InternalDocument_DocumentHeader_PreviewSelected=RGBA(0, 120, 0, 100),
    InternalDocument_DefinitionProperties_Projection_Zoom=1.953125,
    InternalDocument_DefinitionObjects_Object0_Container_ClusterInput=[f1, f1],
    InternalDocument_DefinitionObjects_Object0_Container_ClusterOutput=f1,
    InternalDocument_DefinitionObjects_Object0_Container_InternalDocument_plugin_version=(1, 0, 7))  # -> Data, Data_2
f1_2 = FlattenOneLevel(
    Data=srf4pt_2,
    Data_2=srf4pt_2,
    ParamViewer=f1.Data,
    Branch=f1.ParamViewer,
    List=f1.Indices,
    Shift=expr("-x", f1.Integer),
    Wrap=False,
    Index=f1.List,
    Integer=f1.Integer,
    Data_3=f1.Data,
    Search=f1.ParamViewer,
    Replace=flatten(f1.Branch),
    Data_4=f1.Data,
    Data_5=f1.Data,
    Data_6=f1.Data,
    Integer_2=f1.Pan,
    Data_7=f1.Data,
    Integer_3=f1.Pan,
    Data_8=f1.Data,
    Data_9=f1.Data,
    ClusterInput=f1,
    ClusterOutput=f1,
    InternalDocument_plugin_version=(1, 0, 7),
    InternalDocument_DocumentHeader_PreviewMeshType=1,
    InternalDocument_DocumentHeader_PreviewNormal=RGBA(150, 0, 0, 100),
    InternalDocument_DocumentHeader_PreviewSelected=RGBA(0, 120, 0, 100),
    InternalDocument_DefinitionProperties_Projection_Zoom=1.953125,
    InternalDocument_DefinitionObjects_Object0_Container_ClusterInput=[f1, f1],
    InternalDocument_DefinitionObjects_Object0_Container_ClusterOutput=f1,
    InternalDocument_DefinitionObjects_Object0_Container_InternalDocument_plugin_version=(1, 0, 7))  # -> Data, Data_2
pt_9 = PointXYZ(XComponent=series, YComponent=0, ZComponent=0)
graft_3 = GraftTree(Data=f1_2.Data_2, Strip=False)
graft_4 = GraftTree(Data=f1.Data_2, Strip=False)
merge_30 = Merge(StreamA=graft_3, StreamB=graft_4)
partial_flatten = PartialFlatten(
    Data=merge_30,
    Integer="2",
    Data_2=merge_30,
    Integer_2="2",
    ParamViewer=f1.Data,
    Branch=f1.ParamViewer,
    List=f1.Indices,
    Shift=expr("-x", f1.Integer),
    Wrap=False,
    Index=f1.List,
    Integer_3=f1.Integer,
    Data_3=f1.Data,
    Search=f1.ParamViewer,
    Replace=flatten(f1.Branch),
    Data_4=f1.Data,
    Data_5=f1.Data,
    ClusterInput=[f1, f1],
    ClusterOutput=f1,
    InternalDocument_plugin_version=(1, 0, 7),
    InternalDocument_DocumentHeader_PreviewMeshType=1,
    InternalDocument_DocumentHeader_PreviewNormal=RGBA(150, 0, 0, 100),
    InternalDocument_DocumentHeader_PreviewSelected=RGBA(0, 120, 0, 100),
    InternalDocument_DefinitionProperties_Projection_Zoom=0.8000000119)  # -> Data, Data_2
srf = Surface(partial_flatten.Data_2)
eval = EvaluateSurface(Surface=reparameterize(srf), Point="0.5,0.5,0")  # -> Point, Normal, Frame
xy = XYPlane(Origin=pt_9)
item_46 = ListItem(List=eval.Frame, Index=0, Wrap=False)
graft_5 = GraftTree(Data=xy, Strip=False)
orient = Orient(Geometry=srf, Initial=item_46, Final=graft_5)  # -> Geometry, Transform

# ---- group: Exploded Strips
bbox_21 = BoundingBox(Content=flatten(srf), Union=True, Plane=PlaneXY(0, 0, 0))  # -> Box, Box_2
slider_2 = Slider(55.75, range=0..100)
box = BoxComponents(Box=bbox_21.Box)  # -> Plane, X, Y, Z
num_2 = Number(box.Z)
addition_2 = Addition(A=num_2, B=slider_2)
join = BrepJoin(Breps=srf)  # -> Breps, Closed
moveout = ExplodeOutward(
    Geometry=flatten(join.Breps),
    Number=explosion_distance,
    Geometry_2=flatten(join.Breps),
    Number_2=explosion_distance,
    Geometry_3=moveout.Geometry,
    Content=moveout.Geometry,
    Union=False,
    Plane=PlaneXY(0, 0, 0),
    Content_2=moveout.Geometry,
    Union_2=True,
    Plane_2=PlaneXY(0, 0, 0),
    Box=moveout.Box,
    UParameter=0.5,
    VParameter=0.5,
    WParameter=0.5,
    Box_2=moveout.Box,
    UParameter_2=0.5,
    VParameter_2=0.5,
    WParameter_2=0.5,
    PointA=moveout.Point,
    PointB=moveout.Point,
    Unitize=False,
    Vector=moveout.Vector,
    Amplitude=moveout.Result,
    Number_3=moveout.Number,
    Geometry_4=moveout.Geometry,
    Translation=moveout.Vector,
    Geometry_5=moveout.Geometry,
    A=moveout.Result,
    B=moveout.Number,
    Input=moveout.Length,
    A_2=moveout.Pan,
    B_2=moveout.ArithmeticMean,
    A_3=moveout.Vector,
    B_3=moveout.Result,
    InternalDocument_plugin_version=(1, 0, 7),
    InternalDocument_DocumentHeader_PreviewMeshType=1,
    InternalDocument_DocumentHeader_PreviewNormal=RGBA(150, 0, 0, 100),
    InternalDocument_DocumentHeader_PreviewSelected=RGBA(0, 120, 0, 100),
    InternalDocument_DefinitionProperties_Projection_Zoom=0.8000000119)  # -> Geometry, Geometry_2
Z = UnitZ(Factor=addition_2)
move_5 = Move(Geometry=moveout.Geometry_2, Translation=Z)  # -> Geometry, Transform

# ---- group: Inputs (continued)
exploded_strips = Brep(move_5.Geometry)

# ---- group: Unroll Strips Flat
srf_2 = Surface(orient.Geometry)
shift = ShiftList(List=srf_2, Shift=-1, Wrap=False)
shift_2 = ShiftList(List=srf_2, Shift=1, Wrap=False)
srf_3 = Surface(shift)
eval_2 = EvaluateSurface(Surface=reparameterize(shift_2), Point="0.5,0.5,0")  # -> Point, Normal, Frame
eval_3 = EvaluateSurface(Surface=reparameterize(srf_3), Point="0.5,0.5,0")  # -> Point, Normal, Frame
edges = BrepEdges(Brep=srf_3)  # -> Naked, Interior, NonManifold
midpt_6 = CurveMidpoint(
    Curve=reparameterize(edges.Naked),
    Curve_2=reparameterize(edges.Naked),
    Curve_3=reparameterize(midpt_6.Curve),
    Parameter=midpt_6.Pan,
    Curve_4=midpt_6.Curve,
    Point=midpt_6.Point,
    InternalDocument_plugin_version=(1, 0, 7),
    InternalDocument_DocumentHeader_PreviewMeshType=1,
    InternalDocument_DocumentHeader_PreviewNormal=RGBA(150, 0, 0, 100),
    InternalDocument_DocumentHeader_PreviewSelected=RGBA(0, 120, 0, 100),
    InternalDocument_DefinitionProperties_Projection_Zoom=0.8000000715)  # -> Point, Point_2
srf_cp = SurfaceCP(Point=midpt_6.Point_2, Surface=graft(shift_2))  # -> Point, UVPoint, Distance
sort = SortList(Keys=srf_cp.Distance, ValuesA=edges.Naked)  # -> List, ValuesA
item_47 = ListItem(List=sort.ValuesA, Index=0, Wrap=False)
pframe = PerpFrame(Curve=reparameterize(item_47), Parameter="0.5")
align = AlignPlane(Plane=pframe, Direction=graft(eval_2.Normal))  # -> Plane, Angle
align_2 = AlignPlane(Plane=pframe, Direction=graft(eval_3.Normal))  # -> Plane, Angle
orient_2 = Orient(Initial=align.Plane, Final=align_2.Plane)  # -> Geometry, Transform
partial_flatten_2 = PartialFlatten(
    Data=orient_2.Transform,
    Integer="2",
    Data_2=orient_2.Transform,
    Integer_2="2",
    ParamViewer=f1.Data,
    Branch=f1.ParamViewer,
    List=f1.Indices,
    Shift=expr("-x", f1.Integer),
    Wrap=False,
    Index=f1.List,
    Integer_3=f1.Integer,
    Data_3=f1.Data,
    Search=f1.ParamViewer,
    Replace=flatten(f1.Branch),
    Data_4=f1.Data,
    Data_5=f1.Data,
    ClusterInput=[f1, f1],
    ClusterOutput=f1,
    InternalDocument_plugin_version=(1, 0, 7),
    InternalDocument_DocumentHeader_PreviewMeshType=1,
    InternalDocument_DocumentHeader_PreviewNormal=RGBA(150, 0, 0, 100),
    InternalDocument_DocumentHeader_PreviewSelected=RGBA(0, 120, 0, 100),
    InternalDocument_DefinitionProperties_Projection_Zoom=0.8000000119)  # -> Data, Data_2
lng_2 = ListLength(List=partial_flatten_2.Data_2)
series_2 = Series(Start=0, Step=1, Count=lng_2)
graft_6 = GraftTree(Data=series_2, Strip=False)
series_3 = Series(Start=0, Step=1, Count=expr("x+1", graft_6))
f1_3 = FlattenOneLevel(
    Data=series_3,
    Data_2=series_3,
    ParamViewer=f1.Data,
    Branch=f1.ParamViewer,
    List=f1.Indices,
    Shift=expr("-x", f1.Integer),
    Wrap=False,
    Index=f1.List,
    Integer=f1.Integer,
    Data_3=f1.Data,
    Search=f1.ParamViewer,
    Replace=flatten(f1.Branch),
    Data_4=f1.Data,
    Data_5=f1.Data,
    Data_6=f1.Data,
    Integer_2=f1.Pan,
    Data_7=f1.Data,
    Integer_3=f1.Pan,
    Data_8=f1.Data,
    Data_9=f1.Data,
    ClusterInput=f1,
    ClusterOutput=f1,
    InternalDocument_plugin_version=(1, 0, 7),
    InternalDocument_DocumentHeader_PreviewMeshType=1,
    InternalDocument_DocumentHeader_PreviewNormal=RGBA(150, 0, 0, 100),
    InternalDocument_DocumentHeader_PreviewSelected=RGBA(0, 120, 0, 100),
    InternalDocument_DefinitionProperties_Projection_Zoom=1.953125,
    InternalDocument_DefinitionObjects_Object0_Container_ClusterInput=[f1, f1],
    InternalDocument_DefinitionObjects_Object0_Container_ClusterOutput=f1,
    InternalDocument_DefinitionObjects_Object0_Container_InternalDocument_plugin_version=(1, 0, 7))  # -> Data, Data_2
graft_7 = GraftTree(Data=f1_3.Data_2, Strip=False)
dpath = DataPaths(
    Data=graft_7,
    Data_2=graft_7,
    Data_3=dpath.Data,
    DataPath=dpath.ParamViewer,
    ParamViewer=dpath.Data,
    DataPath_2=dpath.DataPath,
    InternalDocument_plugin_version=(1, 0, 7),
    InternalDocument_DocumentHeader_PreviewMeshType=1,
    InternalDocument_DocumentHeader_PreviewNormal=RGBA(150, 0, 0, 100),
    InternalDocument_DocumentHeader_PreviewSelected=RGBA(0, 120, 0, 100),
    InternalDocument_DefinitionProperties_Projection_Zoom=0.8000000715)  # -> DataPath, DataPath_2
branch = DecomposeBranch(Branch=dpath.DataPath_2)
f1_4 = FlattenOneLevel(
    Data=shift_2,
    Data_2=shift_2,
    ParamViewer=f1.Data,
    Branch=f1.ParamViewer,
    List=f1.Indices,
    Shift=expr("-x", f1.Integer),
    Wrap=False,
    Index=f1.List,
    Integer=f1.Integer,
    Data_3=f1.Data,
    Search=f1.ParamViewer,
    Replace=flatten(f1.Branch),
    Data_4=f1.Data,
    Data_5=f1.Data,
    Data_6=f1.Data,
    Integer_2=f1.Pan,
    Data_7=f1.Data,
    Integer_3=f1.Pan,
    Data_8=f1.Data,
    Data_9=f1.Data,
    ClusterInput=f1,
    ClusterOutput=f1,
    InternalDocument_plugin_version=(1, 0, 7),
    InternalDocument_DocumentHeader_PreviewMeshType=1,
    InternalDocument_DocumentHeader_PreviewNormal=RGBA(150, 0, 0, 100),
    InternalDocument_DocumentHeader_PreviewSelected=RGBA(0, 120, 0, 100),
    InternalDocument_DefinitionProperties_Projection_Zoom=1.953125,
    InternalDocument_DefinitionObjects_Object0_Container_ClusterInput=[f1, f1],
    InternalDocument_DefinitionObjects_Object0_Container_ClusterOutput=f1,
    InternalDocument_DefinitionObjects_Object0_Container_InternalDocument_plugin_version=(1, 0, 7))  # -> Data, Data_2
shift_3 = ShiftList(List=branch, Shift="-3", Wrap=False)
branch_2 = CreateBranch(Index=shift_3)
item_48 = TreeItem(Tree=partial_flatten_2.Data_2, Path=flatten(branch_2), Index=flatten(f1_3.Data_2), Wrap=False)
match_path = MatchPathStructure(
    FlatList=flatten(item_48),
    DataToMatch=f1_3.Data_2,
    FlatList_2=flatten(item_48),
    DataToMatch_2=f1_3.Data_2,
    Data=match_path.Tree,
    Search=match_path.ParamViewer,
    Replace=flatten(match_path.Data),
    ParamViewer=match_path.Data,
    Data_2=match_path.Tree,
    Number=match_path.Length,
    Order=True,
    List=match_path.Data,
    Data_3=match_path.ParamViewer,
    Strip=False,
    ParamViewer_2=match_path.Tree,
    Data_4=match_path.Data,
    Strip_2=False,
    DataToMatch_3=match_path.Data,
    FlatList_3=flatten(match_path.Data),
    Data_5=match_path.Data,
    InternalDocument_plugin_version=(1, 0, 7),
    InternalDocument_DocumentHeader_PreviewMeshType=1,
    InternalDocument_DocumentHeader_PreviewNormal=RGBA(150, 0, 0, 100),
    InternalDocument_DocumentHeader_PreviewSelected=RGBA(0, 120, 0, 100),
    InternalDocument_DefinitionProperties_Projection_Zoom=0.4096000195)  # -> Data, Data_2
item_49 = ListItem(List=shift, Index=0, Wrap=False)

# ----
rev = ReverseList(List=match_path.Data_2)

# ---- group: Unroll Strips Flat (continued)
comp = Compound(Transforms=rev)
partial_flatten_3 = PartialFlatten(
    Data=comp,
    Integer="2",
    Data_2=comp,
    Integer_2="2",
    ParamViewer=f1.Data,
    Branch=f1.ParamViewer,
    List=f1.Indices,
    Shift=expr("-x", f1.Integer),
    Wrap=False,
    Index=f1.List,
    Integer_3=f1.Integer,
    Data_3=f1.Data,
    Search=f1.ParamViewer,
    Replace=flatten(f1.Branch),
    Data_4=f1.Data,
    Data_5=f1.Data,
    ClusterInput=[f1, f1],
    ClusterOutput=f1,
    InternalDocument_plugin_version=(1, 0, 7),
    InternalDocument_DocumentHeader_PreviewMeshType=1,
    InternalDocument_DocumentHeader_PreviewNormal=RGBA(150, 0, 0, 100),
    InternalDocument_DocumentHeader_PreviewSelected=RGBA(0, 120, 0, 100),
    InternalDocument_DefinitionProperties_Projection_Zoom=0.8000000119)  # -> Data, Data_2
transform = Transform(Geometry=f1_4.Data_2, Transform=partial_flatten_3.Data_2)
merge_31 = Merge(StreamA=transform, StreamB=item_49)
join_2 = BrepJoin(Breps=flatten(merge_31))  # -> Breps, Closed

# ----
brep_2 = Brep(join_2.Breps)

# ---- group: Array unfolded strips
tight_bounding_srf = Cluster(
    Brep=graft(brep_2),
    Brep_2=graft(brep_2),
    Brep_3=graft(tight_bounding_srf.Brep),
    Content=tight_bounding_srf.Brep,
    Union=False,
    Plane=tight_bounding_srf.Plane,
    Origin=Point(0, 0, 0),
    Plane_2=tight_bounding_srf.Plane,
    Angle=tight_bounding_srf.Range,
    Domain=tight_bounding_srf.Pan,
    Steps=10,
    Box=tight_bounding_srf.Box,
    C=tight_bounding_srf.Curves,
    Keys=tight_bounding_srf.Data,
    ValuesA=tight_bounding_srf.Data,
    List=tight_bounding_srf.ValuesA,
    Index=0,
    Wrap=False,
    CornerA=tight_bounding_srf.CornerA,
    CornerB=tight_bounding_srf.CornerB,
    CornerC=tight_bounding_srf.CornerC,
    CornerD=tight_bounding_srf.CornerD,
    Brep_4=tight_bounding_srf.Data,
    Curves=tight_bounding_srf.Naked,
    Preserve=False,
    ParamViewer=f1.Data,
    Branch=f1.ParamViewer,
    List_2=f1.Indices,
    Shift=expr("-x", f1.Integer),
    Wrap_2=False,
    Index_2=f1.List,
    Integer=f1.Integer,
    Data=f1.Data,
    Search=f1.ParamViewer,
    Replace=flatten(f1.Branch),
    Data_2=f1.Data,
    Data_3=f1.Data,
    Data_4=f1.Data,
    Integer_2=f1.Pan,
    Data_5=f1.Data,
    Integer_3=f1.Pan,
    Data_6=f1.Data,
    Data_7=f1.Data,
    Data_8=tight_bounding_srf.Surface,
    Data_9=tight_bounding_srf.Surface,
    ParamViewer_2=f1.Data,
    Branch_2=f1.ParamViewer,
    List_3=f1.Indices,
    Shift_2=expr("-x", f1.Integer),
    Wrap_3=False,
    Index_3=f1.List,
    Integer_4=f1.Integer,
    Data_10=f1.Data,
    Search_2=f1.ParamViewer,
    Replace_2=flatten(f1.Branch),
    Data_11=f1.Data,
    Data_12=f1.Data,
    Data_13=tight_bounding_srf.ResultA,
    Integer_5=tight_bounding_srf.Pan,
    Data_14=tight_bounding_srf.ResultA,
    Integer_6=tight_bounding_srf.Pan,
    Element=tight_bounding_srf.Element,
    InternalDocument_plugin_version=(1, 0, 7),
    InternalDocument_DocumentHeader_PreviewMeshType=1,
    InternalDocument_DocumentHeader_PreviewNormal=RGBA(150, 0, 0, 100),
    InternalDocument_DocumentHeader_PreviewSelected=RGBA(0, 120, 0, 100),
    InternalDocument_DefinitionProperties_Projection_Zoom=0.7999999523,
    InternalDocument_DefinitionObjects_Object13_Container_ClusterInput=f1,
    InternalDocument_DefinitionObjects_Object13_Container_ClusterOutput=f1,
    InternalDocument_DefinitionObjects_Object13_Container_InternalDocument_plugin_version=(1, 0, 7),
    InternalDocument_DefinitionObjects_Object14_Container_ClusterInput=[f1, f1],
    InternalDocument_DefinitionObjects_Object14_Container_ClusterOutput=f1,
    InternalDocument_DefinitionObjects_Object14_Container_InternalDocument_plugin_version=(1, 0, 7))  # -> Element, Element_2
dim = Dimensions(Surface=tight_bounding_srf.Element_2)  # -> UDimension, VDimension
smaller = SmallerThan(FirstNumber=dim.UDimension, SecondNumber=dim.VDimension)  # -> SmallerThan, OrEqualTo
spacing = Number(layout_spacing)
dim_2 = Dimensions(Surface=tight_bounding_srf.Element_2)  # -> UDimension, VDimension
swap_uv_3 = SwapSurfaceUV(S=tight_bounding_srf.Element_2, b=smaller.SmallerThan)  # -> out, A; inputs S: Surface, b: Boolean; same code as swap_uv_2
X_2 = UnitX(Factor=1)
iso = IsoCurve(Surface=reparameterize(swap_uv_3.A), UVPoint="0.5,0.5,0")  # -> UIsocurve, VIsocurve
min = Minimum(A=dim_2.UDimension, B=dim_2.VDimension)
addition_3 = Addition(A=min, B=spacing)
crv_3 = Curve(iso.VIsocurve)
ma = MassAddition(Input=flatten(["0", addition_3]))  # -> Result, PartialResult
line = LineSV(
    Point="0,0,0",
    Vector=X_2,
    Point_2="0,0,0",
    Vector_2=X_2,
    Vector_3=line.Vector,
    Start=line.Point,
    Direction=line.Vector,
    Length=line.Vector,
    Point_3=line.Point,
    Line=line.Line,
    InternalDocument_plugin_version=(1, 0, 7),
    InternalDocument_DocumentHeader_PreviewMeshType=1,
    InternalDocument_DocumentHeader_PreviewNormal=RGBA(150, 0, 0, 100),
    InternalDocument_DocumentHeader_PreviewSelected=RGBA(0, 120, 0, 100),
    InternalDocument_DefinitionProperties_Projection_Zoom=1)  # -> Line, Line_2
X_3 = UnitX(Factor=flatten(ma.PartialResult))
flip = Flip(Curve=crv_3, Guide=line.Line_2)  # -> Curve, Flag
end_3 = EndPoints(Curve=flip.Curve)  # -> Start, End
move_6 = Move(Geometry="0,0,0", Translation=X_3)  # -> Geometry, Transform
xy_2 = XYPlane(Origin=end_3.Start)
crvtovec = CurveToVector(
    Curve=flip.Curve,
    Curve_2=flip.Curve,
    Curve_3=crvtovec.Curve,
    Curve_4=crvtovec.Curve,
    PointA=crvtovec.Start,
    PointB=crvtovec.End,
    Unitize=False,
    Vector=crvtovec.Vector,
    Vector_2=crvtovec.Vector,
    InternalDocument_plugin_version=(1, 0, 7),
    InternalDocument_DocumentHeader_PreviewMeshType=1,
    InternalDocument_DocumentHeader_PreviewNormal=RGBA(150, 0, 0, 150),
    InternalDocument_DocumentHeader_PreviewSelected=RGBA(0, 150, 0, 150),
    InternalDocument_DefinitionProperties_Revisions_Revision0_Content="Ted Ngai Jan 30, 2009 www.tedngai.net",
    InternalDocument_DefinitionProperties_Projection_Zoom=1.25)  # -> Vector, Vector_2
shift_4 = ShiftList(List=move_6.Geometry, Shift="-1", Wrap=False)
xy_3 = XYPlane(Origin=shift_4)
align_3 = AlignPlane(Plane=xy_2, Direction=crvtovec.Vector_2)  # -> Plane, Angle
orient_3 = Orient(Geometry=graft(brep_2), Initial=align_3.Plane, Final=graft(xy_3))  # -> Geometry, Transform

# ---- group: Display Strip Tags
flatten = FlattenTree(Data=orient_3.Geometry, Path="{0}")
box_2 = BoxComponents(Box=flatten)  # -> Plane, X, Y, Z
lng_3 = ListLength(List=flatten)
num_3 = Number(expr("-x/1.5", box_2.Y))
box_3 = EvaluateBox(Box=flatten, UParameter=0.5, VParameter=0.5, WParameter=0.5)  # -> Plane, Point, Include
seq = Sequence(Count=lng_3, CharPool="ABCDEFGHIJKLMNOPQRSTUVWXYZ", Format="{0}")
Y_3 = UnitY(Factor=num_3)
move_7 = Move(Geometry=box_3.Plane, Translation=Y_3)  # -> Geometry, Transform
tag = TextTag3D(Location=move_7.Geometry, Text=seq, Size="10")

# ---- group: Display Exploded Tags
brep_cp = BrepCP(Point="-10000,-10000,10000", Brep=move_5.Geometry)  # -> Point, Distance
tag_2 = TextTag3D(Location=brep_cp.Point, Text=seq, Size="7")
