# Grasshopper definition wavewalls8.gh (Grasshopper 1.0.7)
# plug-ins: Human

panel = Panel("C:\Users\KarlRoesch\physVLA\wavetheory\wavescattercurve")
panel_2 = Panel("C:\Users\KarlRoesch\physVLA\wavetheory\waveaipred")
python = GhPythonScript(x=panel)  # -> out, flatten(a)
# ---------- python: Python ----------
__author__ = "peychev"
__version__ = "2018.08.27"

import rhinoscriptsyntax as rs

from System.IO import Directory, Path, SearchOption

#a = Directory.GetDirectories(x)

a = Directory.GetFiles(x)

#a = Directory.GetFiles(x,"*",SearchOption.AllDirectories)
# ---------- end python ----------
lng = ListLength(List=python.a)
python_2 = GhPythonScript(x=panel)  # -> out, flatten(a); same code as python
item = ListItem(List=python.a, Index=lng, Wrap=True)
lng_2 = ListLength(List=python_2.a)
file = ReadFile(File=item, PerLineParse=True)
random = Random(Range="-1 to 1", Number=10, Seed=2)
clean = CleanTree(RemoveNulls=True, RemoveInvalid=True, RemoveEmpty=True, Tree=file)  # -> flatten(Tree)
item_2 = ListItem(List=python_2.a, Index=lng_2, Wrap=True)
graft = GraftTree(Tree=random, IncludeEmptyLists=True, IncludeNullItems=True)
file_2 = ReadFile(File=item_2, PerLineParse=True)
random_2 = Random(Range="-1 to 1", Number=10, Seed=2)
split = SplitList(List=clean, Index=Slider(1, range=0..1))  # -> flatten(ListA), ListB
clean_2 = CleanTree(RemoveNulls=True, RemoveInvalid=True, RemoveEmpty=True, Tree=file_2)  # -> flatten(Tree)
graft_2 = GraftTree(Tree=random_2, IncludeEmptyLists=True, IncludeNullItems=True)
split_2 = SplitList(List=clean_2, Index=Slider(1, range=0..1))  # -> flatten(ListA), ListB
tmatch = MatchText(Text=split.ListB, Pattern="basewall1*", Case=True)
tmatch_2 = MatchText(Text=split.ListB, Pattern="basewall2*", Case=True)
tmatch_3 = MatchText(Text=split.ListB, Pattern="basewall3*", Case=True)
tmatch_4 = MatchText(Text=split.ListB, Pattern="basewall4*", Case=True)
dispatch = Dispatch(List=split.ListB, DispatchPattern=tmatch)  # -> ListA, ListB
dispatch_2 = Dispatch(List=split.ListB, DispatchPattern=tmatch_2)  # -> ListA, ListB
tmatch_5 = MatchText(Text=split.ListB, Pattern="basewall5*", Case=True)
tmatch_6 = MatchText(Text=split.ListB, Pattern="basewall6*", Case=True)
dispatch_3 = Dispatch(List=split.ListB, DispatchPattern=tmatch_3)  # -> ListA, ListB
pt = ConstructPoint(XCoordinate=0, YCoordinate=0, ZCoordinate=0)
pt_2 = ConstructPoint(XCoordinate=Slider(6, range=0..10), YCoordinate=0, ZCoordinate=0)
pt_3 = ConstructPoint(XCoordinate=Slider(6, range=0..10), YCoordinate=Slider(4, range=0..10), ZCoordinate=0)
pt_4 = ConstructPoint(XCoordinate=0, YCoordinate=Slider(4, range=0..10), ZCoordinate=0)
dispatch_4 = Dispatch(List=split.ListB, DispatchPattern=tmatch_4)  # -> ListA, ListB
tmatch_7 = MatchText(Text=split_2.ListB, Pattern="basewall1*", Case=True)
tmatch_8 = MatchText(Text=split.ListB, Pattern="basewall7*", Case=True)
tmatch_9 = MatchText(Text=dispatch.ListA, Pattern="basewall10*", Case=True)
tmatch_10 = MatchText(Text=split_2.ListB, Pattern="basewall2*", Case=True)
tmatch_11 = MatchText(Text=split.ListB, Pattern="basewall8*", Case=True)
dispatch_5 = Dispatch(List=split.ListB, DispatchPattern=tmatch_5)  # -> ListA, ListB
tmatch_12 = MatchText(Text=split_2.ListB, Pattern="basewall3*", Case=True)
dispatch_6 = Dispatch(List=split.ListB, DispatchPattern=tmatch_6)  # -> ListA, ListB
tmatch_13 = MatchText(Text=split.ListB, Pattern="basewall9*", Case=True)
tmatch_14 = MatchText(Text=split_2.ListB, Pattern="basewall4*", Case=True)
dispatch_7 = Dispatch(List=split_2.ListB, DispatchPattern=tmatch_7)  # -> ListA, ListB
dispatch_8 = Dispatch(List=split.ListB, DispatchPattern=tmatch_8)  # -> ListA, ListB
dispatch_9 = Dispatch(List=split_2.ListB, DispatchPattern=tmatch_10)  # -> ListA, ListB
tmatch_15 = MatchText(Text=split.ListB, Pattern="basewall10*", Case=True)
dispatch_10 = Dispatch(List=split.ListB, DispatchPattern=tmatch_11)  # -> ListA, ListB
tmatch_16 = MatchText(Text=split_2.ListB, Pattern="basewall5*", Case=True)
tmatch_17 = MatchText(Text=split_2.ListB, Pattern="basewall6*", Case=True)
dispatch_11 = Dispatch(List=split_2.ListB, DispatchPattern=tmatch_12)  # -> ListA, ListB
dispatch_12 = Dispatch(List=dispatch.ListA, DispatchPattern=tmatch_9)  # -> ListA, ListB
dispatch_13 = Dispatch(List=split.ListB, DispatchPattern=tmatch_13)  # -> ListA, ListB
dispatch_14 = Dispatch(List=split_2.ListB, DispatchPattern=tmatch_14)  # -> ListA, ListB
tmatch_18 = MatchText(Text=split_2.ListB, Pattern="basewall7*", Case=True)
ln = Line(StartPoint=pt_3, EndPoint=pt_4)
tmatch_19 = MatchText(Text=dispatch_7.ListA, Pattern="basewall10*", Case=True)
tmatch_20 = MatchText(Text=split_2.ListB, Pattern="basewall8*", Case=True)
dispatch_15 = Dispatch(List=split.ListB, DispatchPattern=tmatch_15)  # -> ListA, ListB
dispatch_16 = Dispatch(List=split_2.ListB, DispatchPattern=tmatch_16)  # -> ListA, ListB
dispatch_17 = Dispatch(List=split_2.ListB, DispatchPattern=tmatch_17)  # -> ListA, ListB
pline = PolyLine(Vertices=[pt, pt_2, pt_3, pt_4], Closed=True)
trigger = Trigger(
    Interval=2000,
    TimerInterval=2000,
    Target=[lng_3, python_3, num, panel_2, python, item, lng, panel, lng_2, python_2, item_2, file_2])  # disabled
tmatch_21 = MatchText(Text=split_2.ListB, Pattern="basewall9*", Case=True)
midpt = CurveMiddle(Curve=ln)
dispatch_18 = Dispatch(List=split_2.ListB, DispatchPattern=tmatch_18)  # -> ListA, ListB
tmatch_22 = MatchText(Text=split_2.ListB, Pattern="basewall10*", Case=True)
dispatch_19 = Dispatch(List=split_2.ListB, DispatchPattern=tmatch_20)  # -> ListA, ListB
dispatch_20 = Dispatch(List=dispatch_7.ListA, DispatchPattern=tmatch_19)  # -> ListA, ListB
dispatch_21 = Dispatch(List=split_2.ListB, DispatchPattern=tmatch_21)  # -> ListA, ListB
area = Area(Geometry=pline)  # -> Area, Centroid
dispatch_22 = Dispatch(List=split_2.ListB, DispatchPattern=tmatch_22)  # -> ListA, ListB
python_3 = GhPythonScript(x="C:\Users\KarlRoesch\physVLA\wavetheory\waveana")  # -> out, flatten(a); same code as python
rep = ReplaceText(Text=dispatch_12.ListB, Find="(", Replace="{", RecursiveReplace=False)
rep_2 = ReplaceText(Text=dispatch_2.ListA, Find="(", Replace="{", RecursiveReplace=False)
rep_3 = ReplaceText(Text=dispatch_3.ListA, Find="(", Replace="{", RecursiveReplace=False)
rep_4 = ReplaceText(Text=dispatch_4.ListA, Find="(", Replace="{", RecursiveReplace=False)
lng_3 = ListLength(List=python_3.a)
rep_5 = ReplaceText(Text=dispatch_5.ListA, Find="(", Replace="{", RecursiveReplace=False)
rep_6 = ReplaceText(Text=rep, Find=")", Replace="}", RecursiveReplace=False)
rep_7 = ReplaceText(Text=dispatch_6.ListA, Find="(", Replace="{", RecursiveReplace=False)
Y = UnitY(Factor=Slider(6, range=0..10))
rep_8 = ReplaceText(Text=rep_2, Find=")", Replace="}", RecursiveReplace=False)
pt_5 = Point(area.Centroid)
rep_9 = ReplaceText(Text=rep_3, Find=")", Replace="}", RecursiveReplace=False)
rep_10 = ReplaceText(Text=dispatch_20.ListB, Find="(", Replace="{", RecursiveReplace=False)
rep_11 = ReplaceText(Text=dispatch_8.ListA, Find="(", Replace="{", RecursiveReplace=False)
num = Number(lng_3)
rep_12 = ReplaceText(Text=dispatch_9.ListA, Find="(", Replace="{", RecursiveReplace=False)
rep_13 = ReplaceText(Text=dispatch_10.ListA, Find="(", Replace="{", RecursiveReplace=False)
rep_14 = ReplaceText(Text=rep_4, Find=")", Replace="}", RecursiveReplace=False)
rep_15 = ReplaceText(Text=dispatch_11.ListA, Find="(", Replace="{", RecursiveReplace=False)
rep_16 = ReplaceText(Text=rep_5, Find=")", Replace="}", RecursiveReplace=False)
move = Move(Geometry=pt_5, Motion=Y)  # -> Geometry, Transform
rep_17 = ReplaceText(Text=dispatch_13.ListA, Find="(", Replace="{", RecursiveReplace=False)
rep_18 = ReplaceText(Text=dispatch_14.ListA, Find="(", Replace="{", RecursiveReplace=False)
addition = Addition(A=num, B=Slider(52, range=0..100))
rep_19 = ReplaceText(Text=rep_7, Find=")", Replace="}", RecursiveReplace=False)
split_3 = TextSplit(Text=rep_6, Separators=",")
rep_20 = ReplaceText(Text=dispatch_15.ListA, Find="(", Replace="{", RecursiveReplace=False)
split_4 = TextSplit(Text=rep_8, Separators=",")
rep_21 = ReplaceText(Text=dispatch_16.ListA, Find="(", Replace="{", RecursiveReplace=False)
rep_22 = ReplaceText(Text=rep_10, Find=")", Replace="}", RecursiveReplace=False)
rep_23 = ReplaceText(Text=rep_11, Find=")", Replace="}", RecursiveReplace=False)
rep_24 = ReplaceText(Text=dispatch_17.ListA, Find="(", Replace="{", RecursiveReplace=False)
split_5 = TextSplit(Text=rep_9, Separators=",")
rep_25 = ReplaceText(Text=rep_12, Find=")", Replace="}", RecursiveReplace=False)
rep_26 = ReplaceText(Text=rep_13, Find=")", Replace="}", RecursiveReplace=False)
split_6 = TextSplit(Text=rep_14, Separators=",")
rep_27 = ReplaceText(Text=rep_15, Find=")", Replace="}", RecursiveReplace=False)
rep_28 = ReplaceText(Text=dispatch_18.ListA, Find="(", Replace="{", RecursiveReplace=False)
rep_29 = ReplaceText(Text=dispatch_19.ListA, Find="(", Replace="{", RecursiveReplace=False)
rep_30 = ReplaceText(Text=rep_17, Find=")", Replace="}", RecursiveReplace=False)
rep_31 = ReplaceText(Text=rep_18, Find=")", Replace="}", RecursiveReplace=False)
split_7 = TextSplit(Text=rep_16, Separators=",")
split_8 = TextSplit(Text=rep_19, Separators=",")
rep_32 = ReplaceText(Text=rep_20, Find=")", Replace="}", RecursiveReplace=False)
rep_33 = ReplaceText(Text=rep_21, Find=")", Replace="}", RecursiveReplace=False)
rep_34 = ReplaceText(Text=dispatch_21.ListA, Find="(", Replace="{", RecursiveReplace=False)
rep_35 = ReplaceText(Text=rep_24, Find=")", Replace="}", RecursiveReplace=False)
split_9 = TextSplit(Text=rep_22, Separators=",")
split_10 = TextSplit(Text=rep_23, Separators=",")
rep_36 = ReplaceText(Text=dispatch_22.ListA, Find="(", Replace="{", RecursiveReplace=False)
split_11 = TextSplit(Text=rep_25, Separators=",")
split_12 = TextSplit(Text=rep_26, Separators=",")
rep_37 = ReplaceText(Text=rep_28, Find=")", Replace="}", RecursiveReplace=False)
split_13 = TextSplit(Text=rep_27, Separators=",")
item_3 = ListItem(List=split_3, Index=Slider(2, range=0..10), Wrap=True)  # -> flatten(Item)
item_4 = ListItem(List=split_3, Index=Slider(4, range=0..10), Wrap=True)  # -> flatten(Item)
item_5 = ListItem(List=split_3, Index=Slider(3, range=0..10), Wrap=True)  # -> flatten(Item)
rep_38 = ReplaceText(Text=rep_29, Find=")", Replace="}", RecursiveReplace=False)
item_6 = ListItem(List=split_4, Index=Slider(2, range=0..10), Wrap=True)  # -> flatten(Item)
item_7 = ListItem(List=split_4, Index=Slider(4, range=0..10), Wrap=True)  # -> flatten(Item)
item_8 = ListItem(List=split_4, Index=Slider(3, range=0..10), Wrap=True)  # -> flatten(Item)
split_14 = TextSplit(Text=rep_30, Separators=",")
split_15 = TextSplit(Text=rep_31, Separators=",")
item_9 = ListItem(List=split_5, Index=Slider(2, range=0..10), Wrap=True)  # -> flatten(Item)
item_10 = ListItem(List=split_5, Index=Slider(4, range=0..10), Wrap=True)  # -> flatten(Item)
item_11 = ListItem(List=split_5, Index=Slider(3, range=0..10), Wrap=True)  # -> flatten(Item)
Y_2 = UnitY(Factor=Slider(10, range=0..10))
rep_39 = ReplaceText(Text=rep_34, Find=")", Replace="}", RecursiveReplace=False)
split_16 = TextSplit(Text=rep_32, Separators=",")
split_17 = TextSplit(Text=rep_33, Separators=",")
item_12 = ListItem(List=split_6, Index=Slider(2, range=0..10), Wrap=True)  # -> flatten(Item)
item_13 = ListItem(List=split_6, Index=Slider(4, range=0..10), Wrap=True)  # -> flatten(Item)
item_14 = ListItem(List=split_6, Index=Slider(3, range=0..10), Wrap=True)  # -> flatten(Item)
split_18 = TextSplit(Text=rep_35, Separators=",")
rep_40 = ReplaceText(Text=rep_36, Find=")", Replace="}", RecursiveReplace=False)
item_15 = ListItem(List=split_7, Index=Slider(2, range=0..10), Wrap=True)  # -> flatten(Item)
item_16 = ListItem(List=split_7, Index=Slider(4, range=0..10), Wrap=True)  # -> flatten(Item)
item_17 = ListItem(List=split_7, Index=Slider(3, range=0..10), Wrap=True)  # -> flatten(Item)
item_18 = ListItem(List=split_8, Index=Slider(2, range=0..10), Wrap=True)  # -> flatten(Item)
split_19 = TextSplit(Text=rep_37, Separators=",")
item_19 = ListItem(List=split_8, Index=Slider(4, range=0..10), Wrap=True)  # -> flatten(Item)
item_20 = ListItem(List=split_8, Index=Slider(3, range=0..10), Wrap=True)  # -> flatten(Item)
move_2 = Move(Geometry=area.Centroid, Motion=Y_2)  # -> Geometry, Transform
split_20 = TextSplit(Text=rep_38, Separators=",")
pt_6 = ConstructPoint(XCoordinate=item_3, YCoordinate=item_5, ZCoordinate=item_4)  # -> flatten(Point)
item_21 = ListItem(List=split_9, Index=Slider(2, range=0..10), Wrap=True)  # -> flatten(Item)
item_22 = ListItem(List=split_10, Index=Slider(2, range=0..10), Wrap=True)  # -> flatten(Item)
item_23 = ListItem(List=split_9, Index=Slider(4, range=0..10), Wrap=True)  # -> flatten(Item)
item_24 = ListItem(List=split_10, Index=Slider(4, range=0..10), Wrap=True)  # -> flatten(Item)
item_25 = ListItem(List=split_9, Index=Slider(3, range=0..10), Wrap=True)  # -> flatten(Item)
item_26 = ListItem(List=split_10, Index=Slider(3, range=0..10), Wrap=True)  # -> flatten(Item)
item_27 = ListItem(List=split_11, Index=Slider(2, range=0..10), Wrap=True)  # -> flatten(Item)
item_28 = ListItem(List=split_11, Index=Slider(4, range=0..10), Wrap=True)  # -> flatten(Item)
item_29 = ListItem(List=split_11, Index=Slider(3, range=0..10), Wrap=True)  # -> flatten(Item)
item_30 = ListItem(List=split_12, Index=Slider(2, range=0..10), Wrap=True)  # -> flatten(Item)
pt_7 = ConstructPoint(XCoordinate=item_6, YCoordinate=item_8, ZCoordinate=item_7)  # -> flatten(Point)
item_31 = ListItem(List=split_12, Index=Slider(4, range=0..10), Wrap=True)  # -> flatten(Item)
item_32 = ListItem(List=split_12, Index=Slider(3, range=0..10), Wrap=True)  # -> flatten(Item)
split_21 = TextSplit(Text=rep_39, Separators=",")
item_33 = ListItem(List=split_13, Index=Slider(2, range=0..10), Wrap=True)  # -> flatten(Item)
item_34 = ListItem(List=split_13, Index=Slider(4, range=0..10), Wrap=True)  # -> flatten(Item)
item_35 = ListItem(List=split_13, Index=Slider(3, range=0..10), Wrap=True)  # -> flatten(Item)
pt_8 = ConstructPoint(XCoordinate=item_9, YCoordinate=item_11, ZCoordinate=item_10)  # -> flatten(Point)
split_22 = TextSplit(Text=rep_40, Separators=",")
pt_9 = ConstructPoint(XCoordinate=0, YCoordinate=0, ZCoordinate=0)
vec2pt = Vector2Pt(PointA=area.Centroid, PointB=move_2.Geometry, Unitize=False)  # -> Vector, Length
item_36 = ListItem(List=split_14, Index=Slider(2, range=0..10), Wrap=True)  # -> flatten(Item)
item_37 = ListItem(List=split_15, Index=Slider(2, range=0..10), Wrap=True)  # -> flatten(Item)
item_38 = ListItem(List=split_14, Index=Slider(4, range=0..10), Wrap=True)  # -> flatten(Item)
item_39 = ListItem(List=split_14, Index=Slider(3, range=0..10), Wrap=True)  # -> flatten(Item)
item_40 = ListItem(List=split_15, Index=Slider(4, range=0..10), Wrap=True)  # -> flatten(Item)
item_41 = ListItem(List=split_15, Index=Slider(3, range=0..10), Wrap=True)  # -> flatten(Item)
pt_10 = ConstructPoint(XCoordinate=item_12, YCoordinate=item_14, ZCoordinate=item_13)  # -> flatten(Point)
intcrv = Interpolate(Vertices=pt_6, Degree=3, Periodic=False, KnotStyle=1)  # -> Curve, Length, Domain
item_42 = ListItem(List=split_16, Index=Slider(2, range=0..10), Wrap=True)  # -> flatten(Item)
item_43 = ListItem(List=split_16, Index=Slider(4, range=0..10), Wrap=True)  # -> flatten(Item)
item_44 = ListItem(List=split_16, Index=Slider(3, range=0..10), Wrap=True)  # -> flatten(Item)
item_45 = ListItem(List=split_17, Index=Slider(2, range=0..10), Wrap=True)  # -> flatten(Item)
item_46 = ListItem(List=split_17, Index=Slider(4, range=0..10), Wrap=True)  # -> flatten(Item)
item_47 = ListItem(List=split_17, Index=Slider(3, range=0..10), Wrap=True)  # -> flatten(Item)
pt_11 = ConstructPoint(XCoordinate=item_15, YCoordinate=item_17, ZCoordinate=item_16)  # -> flatten(Point)
item_48 = ListItem(List=split_18, Index=Slider(2, range=0..10), Wrap=True)  # -> flatten(Item)
item_49 = ListItem(List=split_18, Index=Slider(4, range=0..10), Wrap=True)  # -> flatten(Item)
item_50 = ListItem(List=split_18, Index=Slider(3, range=0..10), Wrap=True)  # -> flatten(Item)
pt_12 = ConstructPoint(XCoordinate=item_18, YCoordinate=item_20, ZCoordinate=item_19)  # -> flatten(Point)
intcrv_2 = Interpolate(Vertices=pt_7, Degree=3, Periodic=False, KnotStyle=1)  # -> Curve, Length, Domain
pt_13 = ConstructPoint(XCoordinate=item_21, YCoordinate=item_25, ZCoordinate=item_23)  # -> flatten(Point)
intcrv_3 = Interpolate(Vertices=pt_8, Degree=3, Periodic=False, KnotStyle=1)  # -> Curve, Length, Domain
item_51 = ListItem(List=split_19, Index=Slider(2, range=0..10), Wrap=True)  # -> flatten(Item)
item_52 = ListItem(List=split_19, Index=Slider(4, range=0..10), Wrap=True)  # -> flatten(Item)
item_53 = ListItem(List=split_19, Index=Slider(3, range=0..10), Wrap=True)  # -> flatten(Item)
pt_14 = ConstructPoint(XCoordinate=item_22, YCoordinate=item_26, ZCoordinate=item_24)  # -> flatten(Point)
yz = YZPlane(Origin=pt_9)
number_slider = Slider(10, range=0..100)
intcrv_4 = Interpolate(Vertices=pt_10, Degree=3, Periodic=False, KnotStyle=1)  # -> Curve, Length, Domain
item_54 = ListItem(List=split_20, Index=Slider(2, range=0..10), Wrap=True)  # -> flatten(Item)
pt_15 = ConstructPoint(XCoordinate=item_27, YCoordinate=item_29, ZCoordinate=item_28)  # -> flatten(Point)
item_55 = ListItem(List=split_20, Index=Slider(4, range=0..10), Wrap=True)  # -> flatten(Item)
item_56 = ListItem(List=split_20, Index=Slider(3, range=0..10), Wrap=True)  # -> flatten(Item)
pt_16 = ConstructPoint(XCoordinate=item_30, YCoordinate=item_32, ZCoordinate=item_31)  # -> flatten(Point)
arrlinear = LinearArray(Geometry=pline, Direction=vec2pt.Vector, Count=number_slider)  # -> Geometry, Transform
pt_17 = ConstructPoint(XCoordinate=item_33, YCoordinate=item_35, ZCoordinate=item_34)  # -> flatten(Point)
intcrv_5 = Interpolate(Vertices=pt_11, Degree=3, Periodic=False, KnotStyle=1)  # -> Curve, Length, Domain
item_57 = ListItem(List=split_21, Index=Slider(2, range=0..10), Wrap=True)  # -> flatten(Item)
item_58 = ListItem(List=split_21, Index=Slider(4, range=0..10), Wrap=True)  # -> flatten(Item)
item_59 = ListItem(List=split_21, Index=Slider(3, range=0..10), Wrap=True)  # -> flatten(Item)
intcrv_6 = Interpolate(Vertices=pt_12, Degree=3, Periodic=False, KnotStyle=1)  # -> Curve, Length, Domain
pt_18 = ConstructPoint(XCoordinate=item_36, YCoordinate=item_39, ZCoordinate=item_38)  # -> flatten(Point)
pt_19 = ConstructPoint(XCoordinate=item_37, YCoordinate=item_41, ZCoordinate=item_40)  # -> flatten(Point)
intcrv_7 = Interpolate(Vertices=pt_13, Degree=3, Periodic=False, KnotStyle=1)  # -> Curve, Length, Domain
item_60 = ListItem(List=split_22, Index=Slider(2, range=0..10), Wrap=True)  # -> flatten(Item)
item_61 = ListItem(List=split_22, Index=Slider(4, range=0..10), Wrap=True)  # -> flatten(Item)
item_62 = ListItem(List=split_22, Index=Slider(3, range=0..10), Wrap=True)  # -> flatten(Item)
pt_20 = ConstructPoint(XCoordinate=item_42, YCoordinate=item_44, ZCoordinate=item_43)  # -> flatten(Point)
pt_21 = ConstructPoint(XCoordinate=item_45, YCoordinate=item_47, ZCoordinate=item_46)  # -> flatten(Point)
intcrv_8 = Interpolate(Vertices=pt_14, Degree=3, Periodic=False, KnotStyle=1)  # -> Curve, Length, Domain
pt_22 = ConstructPoint(XCoordinate=item_48, YCoordinate=item_50, ZCoordinate=item_49)  # -> flatten(Point)
intcrv_9 = Interpolate(Vertices=pt_16, Degree=3, Periodic=False, KnotStyle=1)  # -> Curve, Length, Domain
intcrv_10 = Interpolate(Vertices=pt_15, Degree=3, Periodic=False, KnotStyle=1)  # -> Curve, Length, Domain
intcrv_11 = Interpolate(Vertices=pt_17, Degree=3, Periodic=False, KnotStyle=1)  # -> Curve, Length, Domain
arrpolar = PolarArray(Geometry=pline, Plane=yz, Count=number_slider, Angle=6.283185307)  # -> Geometry, Transform
pt_23 = ConstructPoint(XCoordinate=item_51, YCoordinate=item_53, ZCoordinate=item_52)  # -> flatten(Point)
intcrv_12 = Interpolate(Vertices=pt_19, Degree=3, Periodic=False, KnotStyle=1)  # -> Curve, Length, Domain
intcrv_13 = Interpolate(Vertices=pt_18, Degree=3, Periodic=False, KnotStyle=1)  # -> Curve, Length, Domain
pt_24 = ConstructPoint(XCoordinate=item_54, YCoordinate=item_56, ZCoordinate=item_55)  # -> flatten(Point)
intcrv_14 = Interpolate(Vertices=pt_20, Degree=3, Periodic=False, KnotStyle=1)  # -> Curve, Length, Domain
intcrv_15 = Interpolate(Vertices=pt_21, Degree=3, Periodic=False, KnotStyle=1)  # -> Curve, Length, Domain
graft_3 = GraftTree(Tree=arrlinear.Geometry, IncludeEmptyLists=True, IncludeNullItems=True)
intcrv_16 = Interpolate(Vertices=pt_22, Degree=3, Periodic=False, KnotStyle=1)  # -> Curve, Length, Domain
pt_25 = ConstructPoint(XCoordinate=item_57, YCoordinate=item_59, ZCoordinate=item_58)  # -> flatten(Point)
graft_4 = GraftTree(Tree=arrpolar.Geometry, IncludeEmptyLists=True, IncludeNullItems=True)
pt_26 = ConstructPoint(XCoordinate=item_60, YCoordinate=item_62, ZCoordinate=item_61)  # -> flatten(Point)
intcrv_17 = Interpolate(Vertices=pt_23, Degree=3, Periodic=False, KnotStyle=1)  # -> Curve, Length, Domain
concat = Concatenate(FragmentA=pt_6, FragmentB=";", FragmentC=pt_13)
intcrv_18 = Interpolate(Vertices=pt_24, Degree=3, Periodic=False, KnotStyle=1)  # -> Curve, Length, Domain
bang = ExplodeTree(Data=graft_3)  # -> Branch0, Branch1, Branch2, Branch3, Branch4, Branch5, Branch6, Branch7, Branch8, Branch9
concat_2 = Concatenate(FragmentA=pt_7, FragmentB=";", FragmentC=pt_15)
bang_2 = ExplodeTree(Data=graft_4)  # -> Branch0, Branch1, Branch2, Branch3, Branch4, Branch5, Branch6, Branch7, Branch8, Branch9
intcrv_19 = Interpolate(Vertices=pt_25, Degree=3, Periodic=False, KnotStyle=1)  # -> Curve, Length, Domain
intcrv_20 = Interpolate(Vertices=pt_26, Degree=3, Periodic=False, KnotStyle=1)  # -> Curve, Length, Domain
concat_3 = Concatenate(FragmentA=pt_8, FragmentB=";", FragmentC=pt_17)
concat_4 = Concatenate(FragmentA=pt_10, FragmentB=";", FragmentC=pt_19)
debrep = DeconstructBrep(Brep=bang.Branch0)  # -> Faces, Edges, Vertices
concat_5 = Concatenate(FragmentA=pt_11, FragmentB=";", FragmentC=pt_21)
concat_6 = Concatenate(FragmentA=pt_12, FragmentB=";", FragmentC=pt_22)
concat_7 = Concatenate(FragmentA=pt_18, FragmentB=";", FragmentC=pt_25)
concat_8 = Concatenate(FragmentA=pt_14, FragmentB=";", FragmentC=pt_23)
concat_9 = Concatenate(FragmentA=pt_16, FragmentB=";", FragmentC=pt_24)
concat_10 = Concatenate(FragmentA=pt_20, FragmentB=";", FragmentC=pt_26)
previewlw = CustomPreviewLineweights(
    Geometry=[intcrv_10.Curve, intcrv_11.Curve, intcrv_12.Curve, intcrv_15.Curve, intcrv_16.Curve, intcrv_17.Curve, intcrv_18.Curve, intcrv_19.Curve, intcrv_20.Curve],
    Shader=ColourSwatch(SwatchColor=RGB(255, 255, 255)),
    Thickness=".01",
    Absolute=True)
loft = Loft(Options={Adjust=False, Closed=True, LoftEnds=0, LoftSimp=0, LoftType=0, Rebuild=10, Refit=0.01})
mesh = Mesh(loft)
debrep_2 = DeconstructBrep(Brep=bang_2.Branch0)  # -> Faces, Edges, flatten(Vertices)
demesh = DeconstructMesh(Mesh=mesh)  # -> Vertices, Faces, Colours, Normals
merge = Merge(
    Data1="BW_1P_ORIGINAL;BW_1P_NEW",
    Data2=concat,
    Data3="BW_2P_ORIGINAL;BW_2P_NEW",
    Data4=concat_2,
    Data5="BW_3P_ORIGINAL;BW_3P_NEW",
    Data6=concat_3,
    Data7="BW_4P_ORIGINAL;BW_4P_NEW",
    Data8=concat_4,
    Data9="BW_5P_ORIGINAL;BW_5P_NEW",
    Data10=concat_5,
    Data11="BW_6P_ORIGINAL;BW_6_NEW",
    Data12=concat_6,
    Data13="BW_7P_ORIGINAL;BW_7_NEW",
    Data14=concat_8,
    Data15="BW_7P_ORIGINAL;BW_7_NEW",
    Data16=concat_9,
    Data17="BW_8P_ORIGINAL;BW_8_NEW",
    Data18=concat_7,
    Data19="BW_9P_ORIGINAL;BW_9_NEW",
    Data20=concat_10)
panel_3 = Panel("basewall1BoundingBox(DimX1,DimX2)basewall1BoundingBox(DimY1,DimY2);basewall1BoundingBoxDimV;basewall1BoundingBoxBottomPoint1;basewall1BoundingBoxBottomPoint2;basewall1BoundingBoxBottomPoint3;basewall1BoundingBoxBottomPoint4")
faceb = FaceBoundaries(Mesh=mesh)
dist = Distance(PointB=demesh.Vertices)
orient = Orient(Geometry=debrep.Faces, Source=PlaneXY(0, 0, 0), Target=debrep_2.Faces)  # -> Geometry, Transform
divide = DivideCurve(Curve=orient.Geometry, Count=10, Kinks=False)  # -> flatten(Points), Tangents, Parameters
crv = Curve(faceb)
bnd = Bounds(Numbers=dist)
graft_5 = GraftTree(Tree=divide.Points, IncludeEmptyLists=True, IncludeNullItems=True)
dedomain = DeconstructDomain(Domain=bnd)  # -> Start, End
graft_6 = GraftTree(Tree=debrep_2.Vertices, IncludeEmptyLists=True, IncludeNullItems=True)
bang_3 = ExplodeTree(Data=graft_5)  # -> Branch0, Branch1, Branch2, Branch3, Branch4, Branch5, Branch6, Branch7, Branch8, Branch9
previewlw_2 = CustomPreviewLineweights(Geometry=crv, Shader=ColourSwatch(SwatchColor=RGB(255, 255, 255)), Thickness=".001", Absolute=True)
bang_4 = ExplodeTree(Data=graft_6)  # -> Branch0, Branch1, Branch2, Branch3
gradient = Gradient(
    LowerLimit=dedomain.Start,
    UpperLimit=dedomain.End,
    Parameter=dist,
    stops=[0: RGB(243, 57, 0), 0.1: RGB(236, 27, 60), 0.2: RGB(210, 0, 118), 0.3: RGB(103, 0, 120), 0.4: RGB(39, 72, 161), 0.5: RGB(1, 192, 229), 0.6: RGB(18, 178, 90), 0.7: RGB(79, 186, 8), 0.8: RGB(220, 237, 32), 0.9: RGB(247, 159, 20), 1: RGB(243, 57, 0)])
panel_5 = Panel(merge)
conmesh = ConstructMesh(Vertices=demesh.Vertices, Faces=demesh.Faces, Colours=gradient)
concat_11 = Concatenate(
    FragmentR=bang_4.Branch0,
    FragmentQ=";",
    FragmentP=bang_4.Branch1,
    FragmentO=";",
    FragmentN=bang_4.Branch2,
    FragmentA=";",
    FragmentB=bang_4.Branch3,
    FragmentC=";",
    FragmentD=bang_3.Branch0,
    FragmentE=bang_3.Branch1,
    FragmentF=bang_3.Branch2,
    FragmentH=bang_3.Branch3,
    FragmentG=bang_3.Branch4,
    FragmentI=bang_3.Branch5,
    FragmentJ=bang_3.Branch6,
    FragmentK=bang_3.Branch7,
    FragmentL=bang_3.Branch8,
    FragmentM=bang_3.Branch9)  # -> flatten(Result)
merge_2 = Merge(Data1="BWBB_1P1;BWBB_1P2;BWBB_1P3;BWBB_1P4;BW_1POINTS", Data2=concat_11)
rep_41 = ReplaceText(Text=merge, Find="{", Replace="(", RecursiveReplace=False)
rep_42 = ReplaceText(Text=rep_41, Find="}", Replace=")", RecursiveReplace=False)
text_data = Text(flatten(rep_42))
concat_12 = Concatenate(
    FragmentC="C:\Users\KarlRoesch\physVLA\wavetheory\waveround2",
    FragmentD="\",
    FragmentA="R2out",
    FragmentE=Slider(1, range=0..100),
    FragmentB=".txt")
path = FilePath(concat_12)
txtwriter = VBScript(filePath=path, data=text_data, append=Toggle(False), activate=Button(), clearFile=Toggle(False))  # -> out, A; inputs data: list
# ---------- txtwriter: VB usings ----------
Imports System.IO
Imports System.Linq
Imports System.Data
Imports System.Drawing
Imports System.Reflection
Imports System.Windows.Forms
Imports System.Xml
Imports System.Xml.Linq
Imports Microsoft.VisualBasic
Imports System.Runtime.InteropServices

Imports Rhino.DocObjects
Imports Rhino.Collections
Imports GH_IO
Imports GH_IO.Serialization
# ---------- txtwriter: VB ----------
    If activate Then

      Dim i As Integer
      Dim aryText(4) As String

      aryText(0) = "True"
      aryText(1) = "Had"
      aryText(2) = "Another"
      aryText(3) = "Little"
      aryText(4) = "One"

      ' the data is appended to the file. If file doesnt exist, a new file is created
      Dim objWriter As New System.IO.StreamWriter(filePath, append)

      For i = 0 To data.Count - 1
        objWriter.WriteLine(data(i))
      Next

      objWriter.Close()
      
      A = aryText(0)

    End If

    If clearFile Then
      Dim objWriter As New System.IO.StreamWriter(filePath, False)
      objWriter.Close()
    End If
# ---------- end txtwriter ----------
data = Data(intcrv.Curve)
data_2 = Data(intcrv_2.Curve)
bbox = BoundingBox(Content=data, Plane=PlaneXY(0, 0, 0), UnionBox=True)  # -> Box, Box_2
debrep_3 = DeconstructBrep(Brep=bang_2.Branch4)  # -> Faces, Edges, flatten(Vertices)
debrep_4 = DeconstructBrep(Brep=bang_2.Branch2)  # -> Faces, Edges, flatten(Vertices)
debrep_5 = DeconstructBrep(Brep=bang_2.Branch5)  # -> Faces, Edges, flatten(Vertices)
debrep_6 = DeconstructBrep(Brep=bang_2.Branch8)  # -> Faces, Edges, flatten(Vertices)
debrep_7 = DeconstructBrep(Brep=bang_2.Branch9)  # -> Faces, Edges, flatten(Vertices)
data_3 = Data(intcrv_4.Curve)
data_4 = Data(intcrv_5.Curve)
debrep_8 = DeconstructBrep(Brep=bang_2.Branch6)  # -> Faces, Edges, flatten(Vertices)
data_5 = Data(intcrv_3.Curve)
debrep_9 = DeconstructBrep(Brep=bang_2.Branch3)  # -> Faces, Edges, Vertices
debrep_10 = DeconstructBrep(Brep=bang_2.Branch7)  # -> Faces, Edges, flatten(Vertices)
bbox_2 = BoundingBox(Content=data_2, Plane=PlaneXY(0, 0, 0), UnionBox=True)  # -> Box, Box_2
debrep_11 = DeconstructBrep(Brep=bang_2.Branch1)  # -> Faces, Edges, flatten(Vertices)
debrep_12 = DeconstructBrep(Brep=bang_2.Branch0)  # -> Faces, Edges, flatten(Vertices)
data_6 = Data(intcrv_6.Curve)
data_7 = Data(intcrv_9.Curve)
data_8 = Data(intcrv_8.Curve)
debrep_13 = DeconstructBrep(Brep=bbox.Box)  # -> Faces, Edges, Vertices
bbox_3 = BoundingBox(Content=data_3, Plane=PlaneXY(0, 0, 0), UnionBox=True)  # -> Box, Box_2
bbox_4 = BoundingBox(Content=data_4, Plane=PlaneXY(0, 0, 0), UnionBox=True)  # -> Box, Box_2
bbox_5 = BoundingBox(Content=data_5, Plane=PlaneXY(0, 0, 0), UnionBox=True)  # -> Box, Box_2
bbox_6 = BoundingBox(Content=data_6, Plane=PlaneXY(0, 0, 0), UnionBox=True)  # -> Box, Box_2
bbox_7 = BoundingBox(Content=data_7, Plane=PlaneXY(0, 0, 0), UnionBox=True)  # -> Box, Box_2
debrep_14 = DeconstructBrep(Brep=bbox_2.Box)  # -> Faces, Edges, Vertices
bbox_8 = BoundingBox(Content=data_8, Plane=PlaneXY(0, 0, 0), UnionBox=True)  # -> Box, Box_2
data_9 = Data(intcrv_13.Curve)
data_10 = Data(intcrv_14.Curve)
debrep_15 = DeconstructBrep(Brep=bbox_3.Box)  # -> Faces, Edges, Vertices
debrep_16 = DeconstructBrep(Brep=bbox_4.Box)  # -> Faces, Edges, Vertices
debrep_17 = DeconstructBrep(Brep=bbox_5.Box)  # -> Faces, Edges, Vertices
bbox_9 = BoundingBox(Content=data_9, Plane=PlaneXY(0, 0, 0), UnionBox=True)  # -> Box, Box_2
debrep_18 = DeconstructBrep(Brep=bbox_6.Box)  # -> Faces, Edges, Vertices
debrep_19 = DeconstructBrep(Brep=bbox_7.Box)  # -> Faces, Edges, Vertices
bbox_10 = BoundingBox(Content=data_10, Plane=PlaneXY(0, 0, 0), UnionBox=True)  # -> Box, Box_2
debrep_20 = DeconstructBrep(Brep=bbox_8.Box)  # -> Faces, Edges, Vertices
orient_2 = Orient(Geometry=data, Source=debrep_13.Faces, Target=debrep_12.Faces)  # -> Geometry, Transform
orient_3 = Orient(Geometry=data_4, Source=debrep_16.Faces, Target=debrep_3.Faces)  # -> Geometry, Transform
orient_4 = Orient(Geometry=data_3, Source=debrep_15.Faces, Target=debrep_9.Faces)  # -> Geometry, Transform
debrep_21 = DeconstructBrep(Brep=bbox_9.Box)  # -> Faces, Edges, Vertices
orient_5 = Orient(Geometry=data_8, Source=debrep_20.Faces, Target=debrep_8.Faces)  # -> Geometry, Transform
orient_6 = Orient(Geometry=data_2, Source=debrep_14.Faces, Target=debrep_11.Faces)  # -> flatten(Geometry), Transform
orient_7 = Orient(Geometry=data_6, Source=debrep_18.Faces, Target=debrep_5.Faces)  # -> Geometry, Transform
orient_8 = Orient(Geometry=data_5, Source=debrep_17.Faces, Target=debrep_4.Faces)  # -> Geometry, Transform
debrep_22 = DeconstructBrep(Brep=bbox_10.Box)  # -> Faces, Edges, Vertices
orient_9 = Orient(Geometry=data_7, Source=debrep_19.Faces, Target=debrep_10.Faces)  # -> Geometry, Transform
orient_10 = Orient(Geometry=data_9, Source=debrep_21.Faces, Target=debrep_6.Faces)  # -> Geometry, Transform
orient_11 = Orient(Geometry=data_10, Source=debrep_22.Faces, Target=debrep_7.Faces)  # -> Geometry, Transform
merge_3 = Merge(Data1=merge_2)
rep_43 = ReplaceText(Text=merge_3, Find="{", Replace="(", RecursiveReplace=False)
rep_44 = ReplaceText(Text=rep_43, Find="}", Replace=")", RecursiveReplace=False)
panel_6 = Panel(rep_44)
rulesrf = RuledSurface(CurveA=orient_4.Geometry, CurveB=orient_3.Geometry)
rulesrf_2 = RuledSurface(CurveA=orient_2.Geometry, CurveB=orient_6.Geometry)
rulesrf_3 = RuledSurface(CurveA=orient_6.Geometry, CurveB=orient_8.Geometry)
rulesrf_4 = RuledSurface(CurveA=orient_3.Geometry, CurveB=orient_7.Geometry)
rulesrf_5 = RuledSurface(CurveA=orient_8.Geometry, CurveB=orient_4.Geometry)
rulesrf_6 = RuledSurface(CurveA=orient_7.Geometry, CurveB=orient_5.Geometry)
rulesrf_7 = RuledSurface(CurveA=orient_5.Geometry, CurveB=orient_9.Geometry)
rulesrf_8 = RuledSurface(CurveA=orient_11.Geometry, CurveB=orient_2.Geometry)
rulesrf_9 = RuledSurface(CurveA=orient_9.Geometry, CurveB=orient_10.Geometry)
text_data_2 = Text(flatten(rep_44))
rulesrf_10 = RuledSurface(CurveA=orient_10.Geometry, CurveB=orient_11.Geometry)
concat_13 = Concatenate(
    FragmentC="C:\Users\KarlRoesch\physVLA\wavetheory\wavein",
    FragmentD="\",
    FragmentA="config",
    FragmentE=addition,
    FragmentB=".txt")
path_2 = FilePath(concat_13)
merge_4 = Merge(
    Data1=rulesrf_2,
    Data2=rulesrf_3,
    Data3=rulesrf_5,
    Data4=rulesrf,
    Data5=rulesrf_4,
    Data6=rulesrf_6,
    Data7=rulesrf_7,
    Data8=rulesrf_9,
    Data9=rulesrf_10,
    Data10=rulesrf_8)  # -> flatten(Result)
txtwriter_2 = VBScript(filePath=path_2, data=text_data_2, append=Toggle(False), activate=Button(), clearFile=Toggle(False))  # -> out, A; inputs data: list; same code as txtwriter
bbox_11 = BoundingBox(Content=merge_4, Plane=PlaneXY(0, 0, 0), UnionBox=True)  # -> Box, Box_2
mesh_2 = Mesh(merge_4)
area_2 = Area(Geometry=bbox_11.Box)  # -> Area, Centroid
demesh_2 = DeconstructMesh(Mesh=mesh_2)  # -> Vertices, Faces, Colours, Normals
faceb_2 = FaceBoundaries(Mesh=mesh_2)
dist_2 = Distance(PointA=area_2.Centroid, PointB=demesh_2.Vertices)
bnd_2 = Bounds(Numbers=dist_2)
crv_2 = Curve(faceb_2)
dedomain_2 = DeconstructDomain(Domain=bnd_2)  # -> Start, End
previewlw_3 = CustomPreviewLineweights(Geometry=crv_2, Shader=ColourSwatch(SwatchColor=RGB(255, 255, 255)), Thickness=".001", Absolute=True)
gradient_2 = Gradient(
    LowerLimit=dedomain_2.Start,
    UpperLimit=dedomain_2.End,
    Parameter=dist_2,
    stops=[0: RGB(243, 57, 0), 0.1: RGB(236, 27, 60), 0.2: RGB(210, 0, 118), 0.3: RGB(103, 0, 120), 0.4: RGB(39, 72, 161), 0.5: RGB(1, 192, 229), 0.6: RGB(18, 178, 90), 0.7: RGB(79, 186, 8), 0.8: RGB(220, 237, 32), 0.9: RGB(247, 159, 20), 1: RGB(243, 57, 0)])
conmesh_2 = ConstructMesh(Vertices=demesh_2.Vertices, Faces=demesh_2.Faces, Colours=gradient_2)
